# Grasshopper definition Estructura.ghx (Grasshopper 1.0.8)
# plug-ins: Pufferfish

# ---- group: Division Media / Inferior
rh_in_11_16_sujecion_inferior_herraje_in = ValueList({"tarugo": 0, "minifix de Presion": 1, "Minifix Roscado": 2, "Tornillo Largo": 3, "Tornillo PT": 4, "Tuerca": 5, "N/A": 6}, selected="tarugo")  # "RH_IN:11.16 Sujecion Inferior Herraje Interno"
rh_in_11_13_sujecion_inferior_herraje_ex = ValueList({"tarugo": 0, "minifix de Presion": 1, "Minifix Roscado": 2, "Tornillo Largo": 3, "Tornillo PT": 4, "Tuerca": 5, "N/A": 6}, selected="tarugo")  # "RH_IN:11.13 Sujecion Inferior Herraje Externo"
rh_in_11_14_posicion = ValueList({"0", "1", "2", "3", "4", "5", "6", "7", "8", "9", "10"}, selected="0")
rh_in_11_17_posicion = ValueList({"0", "1", "2", "3", "4", "5", "6", "7", "8", "9", "10"}, selected="1")
rh_in_11_18_simetria = ValueList({"no": 0, "si": 1}, selected="si")
rh_in_11_19_cambiar_lado = ValueList({"0", "180": "1"}, selected="0")
rh_in_11_15_simetria = ValueList({"no": 0, "si": 1}, selected="si")
rh_in_11_20_altura_division_media = Slider(100, range=100..2200)

# ---- group: Division Media / Superior
rh_in_11_6_sujecion_superior_externo = ValueList({"tarugo": 0, "minifix de Presion": 1, "Minifix Roscado": 2, "Tornillo Largo": 3, "Tornillo PT": 4, "Tuerca": 5, "N/A": 6}, selected="minifix de Presion")
rh_in_11_7_posicion = ValueList({"0", "1", "2", "3", "4", "5", "6", "7", "8", "9", "10"}, selected="0")
rh_in_11_8_simetria = ValueList({"no": 0, "si": 1}, selected="si")
rh_in_11_9_sujecion_superior_interno = ValueList({"tarugo": 0, "minifix de Presion": 1, "Minifix Roscado": 2, "Tornillo Largo": 3, "Tornillo PT": 4, "Tuerca": 5, "N/A": 6}, selected="tarugo")
rh_in_11_10_posicion = ValueList({"0", "1", "2", "3", "4", "5", "6", "7", "8", "9", "10"}, selected="1")
rh_in_11_11_simetria = ValueList({"no": 0, "si": 1}, selected="si")
rh_in_11_12_cambiar_lado = ValueList({"0", "180": "1"}, selected="180")

# ---- group: Division Media / Inferior
rh_in_12_16_sujecion_inferior_herraje_in = ValueList({"tarugo": 0, "minifix de Presion": 1, "Minifix Roscado": 2, "Tornillo Largo": 3, "Tornillo PT": 4, "Tuerca": 5, "N/A": 6}, selected="tarugo")  # "RH_IN:12.16 Sujecion Inferior Herraje Interno"
rh_in_12_13_sujecion_inferior_herraje_ex = ValueList({"tarugo": 0, "minifix de Presion": 1, "Minifix Roscado": 2, "Tornillo Largo": 3, "Tornillo PT": 4, "Tuerca": 5, "N/A": 6}, selected="tarugo")  # "RH_IN:12.13 Sujecion Inferior Herraje Externo"
rh_in_12_14_posicion = ValueList({"0", "1", "2", "3", "4", "5", "6", "7", "8", "9", "10"}, selected="0")
rh_in_12_17_posicion = ValueList({"0", "1", "2", "3", "4", "5", "6", "7", "8", "9", "10"}, selected="1")
rh_in_12_18_simetria = ValueList({"no": 0, "si": 1}, selected="si")
rh_in_12_19_cambiar_lado = ValueList({"0", "180": "1"}, selected="0")
rh_in_12_15_simetria = ValueList({"no": 0, "si": 1}, selected="si")
rh_in_12_20_altura_division_media_derech = Slider(100, range=100..2200)  # "RH_IN:12.20 Altura Division Media Derecha"

# ---- group: Division Media / Superior
rh_in_12_6_sujecion_superior_externo = ValueList({"tarugo": 0, "minifix de Presion": 1, "Minifix Roscado": 2, "Tornillo Largo": 3, "Tornillo PT": 4, "Tuerca": 5, "N/A": 6}, selected="minifix de Presion")
rh_in_12_8_simetria = ValueList({"no": 0, "si": 1}, selected="si")
rh_in_12_9_sujecion_superior_interno = ValueList({"tarugo": 0, "minifix de Presion": 1, "Minifix Roscado": 2, "Tornillo Largo": 3, "Tornillo PT": 4, "Tuerca": 5, "N/A": 6}, selected="tarugo")
rh_in_12_10_posicion = ValueList({"0", "1", "2", "3", "4", "5", "6", "7", "8", "9", "10"}, selected="1")
rh_in_12_11_simetria = ValueList({"no": 0, "si": 1}, selected="si")
rh_in_12_12_cambiar_lado = ValueList({"0", "180": "1"}, selected="180")
rh_in_12_7_posicion = ValueList({"0", "1", "2", "3", "4", "5", "6", "7", "8", "9", "10"}, selected="0")

# ---- group: Division Izquierda / Inferior
rh_in_08_16_sujecion_inferior_herraje_in = ValueList({"tarugo": 0, "minifix de Presion": 1, "Minifix Roscado": 2, "Tornillo Largo": 3, "Tornillo PT": 4, "Tuerca": 5, "N/A": 6}, selected="tarugo")  # "RH_IN:08.16 Sujecion Inferior Herraje Interno"
rh_in_08_13_sujecion_inferior_herraje_ex = ValueList({"tarugo": 0, "minifix de Presion": 1, "Minifix Roscado": 2, "Tornillo Largo": 3, "Tornillo PT": 4, "Tuerca": 5, "N/A": 6}, selected="tarugo")  # "RH_IN:08.13 Sujecion Inferior Herraje Externo"
rh_in_08_14_posicion = ValueList({"0", "1", "2", "3", "4", "5", "6", "7", "8", "9", "10"}, selected="0")
rh_in_08_15_simetria = ValueList({"no": 0, "si": 1}, selected="si")
rh_in_08_17_posicion = ValueList({"0", "1", "2", "3", "4", "5", "6", "7", "8", "9", "10"}, selected="1")
rh_in_08_18_simetria = ValueList({"no": 0, "si": 1}, selected="si")
rh_in_08_19_cambiar_lado = ValueList({"0", "180": "1"}, selected="0")
rh_in_08_20_altura_division_izquierda = Slider(100, range=100..2200)

# ---- group: Division Izquierda / Superior
rh_in_08_6_sujecion_superior_externo = ValueList({"tarugo": 0, "minifix de Presion": 1, "Minifix Roscado": 2, "Tornillo Largo": 3, "Tornillo PT": 4, "Tuerca": 5, "N/A": 6}, selected="minifix de Presion")
rh_in_08_7_posicion = ValueList({"0", "1", "2", "3", "4", "5", "6", "7", "8", "9", "10"}, selected="0")
rh_in_08_8_simetria = ValueList({"no": 0, "si": 1}, selected="si")
rh_in_08_9_sujecion_superior_interno = ValueList({"tarugo": 0, "minifix de Presion": 1, "Minifix Roscado": 2, "Tornillo Largo": 3, "Tornillo PT": 4, "Tuerca": 5, "N/A": 6}, selected="tarugo")
rh_in_08_10_posicion = ValueList({"0", "1", "2", "3", "4", "5", "6", "7", "8", "9", "10"}, selected="1")
rh_in_08_11_simetria = ValueList({"no": 0, "si": 1}, selected="si")
rh_in_08_12_cambiar_lado = ValueList({"0", "180": "1"}, selected="180")

# ---- group: Division Media Izquierda / Inferior
rh_in_10_16_sujecion_inferior_herraje_in = ValueList({"tarugo": 0, "minifix de Presion": 1, "Minifix Roscado": 2, "Tornillo Largo": 3, "Tornillo PT": 4, "Tuerca": 5, "N/A": 6}, selected="tarugo")  # "RH_IN:10.16 Sujecion Inferior Herraje Interno"
rh_in_10_13_sujecion_inferior_herraje_ex = ValueList({"tarugo": 0, "minifix de Presion": 1, "Minifix Roscado": 2, "Tornillo Largo": 3, "Tornillo PT": 4, "Tuerca": 5, "N/A": 6}, selected="tarugo")  # "RH_IN:10.13 Sujecion Inferior Herraje Externo"
rh_in_10_14_posicion = ValueList({"0", "1", "2", "3", "4", "5", "6", "7", "8", "9", "10"}, selected="0")
rh_in_10_17_posicion = ValueList({"0", "1", "2", "3", "4", "5", "6", "7", "8", "9", "10"}, selected="1")
rh_in_10_18_simetria = ValueList({"no": 0, "si": 1}, selected="si")
rh_in_10_19_cambiar_lado = ValueList({"0", "180": "1"}, selected="0")
rh_in_10_15_simetria = ValueList({"no": 0, "si": 1}, selected="si")
rh_in_10_20_altura_division_media_izquie = Slider(100, range=100..2200)  # "RH_IN:10.20 Altura Division Media Izquierda"

# ---- group: Division Media Izquierda / Superior
rh_in_10_6_sujecion_superior_externo = ValueList({"tarugo": 0, "minifix de Presion": 1, "Minifix Roscado": 2, "Tornillo Largo": 3, "Tornillo PT": 4, "Tuerca": 5, "N/A": 6}, selected="minifix de Presion")
rh_in_10_7_posicion = ValueList({"0", "1", "2", "3", "4", "5", "6", "7", "8", "9", "10"}, selected="0")
rh_in_10_8_simetria = ValueList({"no": 0, "si": 1}, selected="si")
rh_in_10_9_sujecion_superior_interno = ValueList({"tarugo": 0, "minifix de Presion": 1, "Minifix Roscado": 2, "Tornillo Largo": 3, "Tornillo PT": 4, "Tuerca": 5, "N/A": 6}, selected="tarugo")
rh_in_10_10_posicion = ValueList({"0", "1", "2", "3", "4", "5", "6", "7", "8", "9", "10"}, selected="1")
rh_in_10_11_simetria = ValueList({"no": 0, "si": 1}, selected="si")
rh_in_10_12_cambiar_lado = ValueList({"0", "180": "1"}, selected="180")

# ---- group: Costado Izquierdo / Inferior
rh_in_05_20_altura_costado_izquierdo = Slider(100, range=100..2200)
rh_in_05_13_sujecion_inferior_herraje_ex = ValueList({"tarugo": 0, "minifix de Presion": 1, "Minifix Roscado": 2, "Tornillo Largo": 3, "Tornillo PT": 4, "Tuerca": 5, "N/A": 6}, selected="tarugo")  # "RH_IN:05.13 Sujecion Inferior Herraje Externo"
rh_in_05_14_posicion = ValueList({"0", "1", "2", "3", "4", "5", "6", "7", "8", "9", "10"}, selected="0")
rh_in_05_15_simetria = ValueList({"no": 0, "si": 1}, selected="si")
rh_in_05_16_sujecion_inferior_herraje_in = ValueList({"tarugo": 0, "minifix de Presion": 1, "Minifix Roscado": 2, "Tornillo Largo": 3, "Tornillo PT": 4, "Tuerca": 5, "N/A": 6}, selected="tarugo")  # "RH_IN:05.16 Sujecion Inferior Herraje Interno"
rh_in_05_17_posicion = ValueList({"0", "1", "2", "3", "4", "5", "6", "7", "8", "9", "10"}, selected="1")
rh_in_05_18_simetria = ValueList({"no": 0, "si": 1}, selected="si")
rh_in_05_19_cambiar_lado = ValueList({"0", "180": "1"}, selected="0")

# ---- group: Division Central / Inferior
rh_in_07_16_sujecion_inferior_herraje_in = ValueList({"tarugo": 0, "minifix de Presion": 1, "Minifix Roscado": 2, "Tornillo Largo": 3, "Tornillo PT": 4, "Tuerca": 5, "N/A": 6}, selected="tarugo")  # "RH_IN:07.16 Sujecion Inferior Herraje Interno"
rh_in_07_13_sujecion_inferior_herraje_ex = ValueList({"tarugo": 0, "minifix de Presion": 1, "Minifix Roscado": 2, "Tornillo Largo": 3, "Tornillo PT": 4, "Tuerca": 5, "N/A": 6}, selected="tarugo")  # "RH_IN:07.13 Sujecion Inferior Herraje Externo"
rh_in_07_14_posicion = ValueList({"0", "1", "2", "3", "4", "5", "6", "7", "8", "9", "10"}, selected="0")
rh_in_07_15_simetria = ValueList({"no": 0, "si": 1}, selected="si")
rh_in_07_17_posicion = ValueList({"0", "1", "2", "3", "4", "5", "6", "7", "8", "9", "10"}, selected="1")
rh_in_07_18_simetria = ValueList({"no": 0, "si": 1}, selected="si")
rh_in_07_19_cambiar_lado = ValueList({"0", "180": "1"}, selected="0")
rh_in_07_20_altura_division_central = Slider(100, range=100..2200)

# ---- group: Costado Derecho / Inferior
rh_in_06_13_sujecion_inferior_herraje_ex = ValueList({"tarugo": 0, "minifix de Presion": 1, "Minifix Roscado": 2, "Tornillo Largo": 3, "Tornillo PT": 4, "Tuerca": 5, "N/A": 6}, selected="tarugo")  # "RH_IN:06.13 Sujecion Inferior Herraje Externo"
rh_in_06_14_posicion = ValueList({"0", "1", "2", "3", "4", "5", "6", "7", "8", "9", "10"}, selected="0")
rh_in_06_15_simetria = ValueList({"no": 0, "si": 1}, selected="si")
rh_in_06_16_sujecion_inferior_herraje_in = ValueList({"tarugo": 0, "minifix de Presion": 1, "Minifix Roscado": 2, "Tornillo Largo": 3, "Tornillo PT": 4, "Tuerca": 5, "N/A": 6}, selected="tarugo")  # "RH_IN:06.16 Sujecion Inferior Herraje Interno"
rh_in_06_17_posicion = ValueList({"0", "1", "2", "3", "4", "5", "6", "7", "8", "9", "10"}, selected="1")
rh_in_06_18_simetria = ValueList({"no": 0, "si": 1}, selected="si")
rh_in_06_19_cambiar_lado = ValueList({"0", "180": "1"}, selected="0")
rh_in_06_20_altura_costado_derecho = Slider(100, range=100..2200)

# ---- group: Division Central / Superior
rh_in_07_6_sujecion_superior_externo = ValueList({"tarugo": 0, "minifix de Presion": 1, "Minifix Roscado": 2, "Tornillo Largo": 3, "Tornillo PT": 4, "Tuerca": 5, "N/A": 6}, selected="minifix de Presion")
rh_in_07_7_posicion = ValueList({"0", "1", "2", "3", "4", "5", "6", "7", "8", "9", "10"}, selected="0")
rh_in_07_8_simetria = ValueList({"no": 0, "si": 1}, selected="si")
rh_in_07_9_sujecion_superior_interno = ValueList({"tarugo": 0, "minifix de Presion": 1, "Minifix Roscado": 2, "Tornillo Largo": 3, "Tornillo PT": 4, "Tuerca": 5, "N/A": 6}, selected="tarugo")
rh_in_07_10_posicion = ValueList({"0", "1", "2", "3", "4", "5", "6", "7", "8", "9", "10"}, selected="1")
rh_in_07_11_simetria = ValueList({"no": 0, "si": 1}, selected="si")
rh_in_07_12_cambiar_lado = ValueList({"0", "180": "1"}, selected="180")

# ---- group: Costado Derecho / Superior
rh_in_06_6_sujecion_superior_externo = ValueList({"tarugo": 0, "minifix de Presion": 1, "Minifix Roscado": 2, "Tornillo Largo": 3, "Tornillo PT": 4, "Tuerca": 5, "N/A": 6}, selected="minifix de Presion")
rh_in_06_7_posicion = ValueList({"0", "1", "2", "3", "4", "5", "6", "7", "8", "9", "10"}, selected="0")
rh_in_06_8_simetria = ValueList({"no": 0, "si": 1}, selected="si")
rh_in_06_9_sujecion_superior_interno = ValueList({"tarugo": 0, "minifix de Presion": 1, "Minifix Roscado": 2, "Tornillo Largo": 3, "Tornillo PT": 4, "Tuerca": 5, "N/A": 6}, selected="tarugo")
rh_in_06_10_posicion = ValueList({"0", "1", "2", "3", "4", "5", "6", "7", "8", "9", "10"}, selected="1")
rh_in_06_11_simetria = ValueList({"no": 0, "si": 1}, selected="si")
rh_in_06_12_cambiar_lado = ValueList({"0", "180": "1"}, selected="180")

# ---- group: Division Derecha / Inferior
rh_in_09_16_sujecion_inferior_herraje_in = ValueList({"tarugo": 0, "minifix de Presion": 1, "Minifix Roscado": 2, "Tornillo Largo": 3, "Tornillo PT": 4, "Tuerca": 5, "N/A": 6}, selected="tarugo")  # "RH_IN:09.16 Sujecion Inferior Herraje Interno"
rh_in_09_13_sujecion_inferior_herraje_ex = ValueList({"tarugo": 0, "minifix de Presion": 1, "Minifix Roscado": 2, "Tornillo Largo": 3, "Tornillo PT": 4, "Tuerca": 5, "N/A": 6}, selected="tarugo")  # "RH_IN:09.13 Sujecion Inferior Herraje Externo"
rh_in_09_14_posicion = ValueList({"0", "1", "2", "3", "4", "5", "6", "7", "8", "9", "10"}, selected="0")
rh_in_09_15_simetria = ValueList({"no": 0, "si": 1}, selected="si")
rh_in_09_17_posicion = ValueList({"0", "1", "2", "3", "4", "5", "6", "7", "8", "9", "10"}, selected="1")
rh_in_09_18_simetria = ValueList({"no": 0, "si": 1}, selected="si")
rh_in_09_19_cambiar_lado = ValueList({"0", "180": "1"}, selected="0")
rh_in_09_20_altura_division_derecha = Slider(100, range=100..2200)

# ---- group: Division Derecha / Superior
rh_in_09_6_sujecion_superior_externo = ValueList({"tarugo": 0, "minifix de Presion": 1, "Minifix Roscado": 2, "Tornillo Largo": 3, "Tornillo PT": 4, "Tuerca": 5, "N/A": 6}, selected="minifix de Presion")
rh_in_09_7_posicion = ValueList({"0", "1", "2", "3", "4", "5", "6", "7", "8", "9", "10"}, selected="0")
rh_in_09_8_simetria = ValueList({"no": 0, "si": 1}, selected="si")
rh_in_09_9_sujecion_superior_interno = ValueList({"tarugo": 0, "minifix de Presion": 1, "Minifix Roscado": 2, "Tornillo Largo": 3, "Tornillo PT": 4, "Tuerca": 5, "N/A": 6}, selected="tarugo")
rh_in_09_10_posicion = ValueList({"0", "1", "2", "3", "4", "5", "6", "7", "8", "9", "10"}, selected="1")
rh_in_09_11_simetria = ValueList({"no": 0, "si": 1}, selected="si")
rh_in_09_12_cambiar_lado = ValueList({"0", "180": "1"}, selected="180")

# ---- group: Costado Izquierdo / Superior
rh_in_05_6_sujecion_superior_externo = ValueList({"tarugo": 0, "minifix de Presion": 1, "Minifix Roscado": 2, "Tornillo Largo": 3, "Tornillo PT": 4, "Tuerca": 5, "N/A": 6}, selected="minifix de Presion")
rh_in_05_7_posicion = ValueList({"0", "1", "2", "3", "4", "5", "6", "7", "8", "9", "10"}, selected="0")
rh_in_05_8_simetria = ValueList({"no": 0, "si": 1}, selected="si")
rh_in_05_9_sujecion_superior_interno = ValueList({"tarugo": 0, "minifix de Presion": 1, "Minifix Roscado": 2, "Tornillo Largo": 3, "Tornillo PT": 4, "Tuerca": 5, "N/A": 6}, selected="tarugo")
rh_in_05_10_posicion = ValueList({"0", "1", "2", "3", "4", "5", "6", "7", "8", "9", "10"}, selected="1")
rh_in_05_11_simetria = ValueList({"no": 0, "si": 1}, selected="si")
rh_in_05_12_cambiar_lado = ValueList({"0", "180": "1"}, selected="180")

# ---- group: Dimensiones Generales
# Estructura
rh_in_01_0_ancho = Slider(1800, range=300..2440)
rh_in_01_1_profundidad = Slider(300, range=200..600)
rh_in_01_2_altura = Slider(1800, range=200..2440)

# ---- group: Divisiones
# Multiplocador de Verticales
panel = Panel("6")
rh_in_02_0_divisiones = ValueList({"0": "1", "1": "2", "2": "3", "3": "4"}, selected="3")

# ----
# Tablero Inferior
panel_2 = Panel("0")
unit_z = UnitZ(Factor="15")

# ----
# Definicion para Patas
_02_2_desfase = Slider(1, range=0..60)
unit_x = UnitX(Factor=_02_2_desfase)
unit_x_2 = UnitX(Factor="32")
unit_y = UnitY(Factor="32")
unit_z_2 = UnitZ(Factor="-15")
panel_3 = Panel("Pata Conica")
panel_4 = Panel("Pata Cilindrica")
panel_5 = Panel("name")

# ----
# Tablero Superior
panel_7 = Panel("6")
unit_z_3 = UnitZ(Factor="-15")
addition = Addition(A=_02_2_desfase, B="15")
unit_x_3 = UnitX(Factor=addition)

# ----
# Pata Conica
brep = Brep(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)
mesh_brep = MeshBrep(
    Brep=brep,
    Settings={GridMaxCount=0, GridMinCount=16, JaggedSeams=False, MaxEdgeLength=0, MinEdgeLength=0.0001, MinTolerance=0, Refine=True, RefineAngle=0, RelativeTolerance=0.65, SimplePlanes=True, Tolerance=0})
point = Point(Point(0, -500, 40))

# ----
# Pata Cilindrica
brep_2 = Brep(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)
point_2 = Point(Point(0, -600, 10))
mesh_brep_2 = MeshBrep(
    Brep=brep_2,
    Settings={GridMaxCount=0, GridMinCount=16, JaggedSeams=False, MaxEdgeLength=0, MinEdgeLength=0.0001, MinTolerance=0, Refine=True, RefineAngle=0, RelativeTolerance=0.65, SimplePlanes=True, Tolerance=0})

# ---- group: Tablero Superior
rh_in_02_1_lado_balance = ValueList({"Cara A", "Cara B", "D/D"}, selected="Cara B")
rh_in_02_2_canto_frontal = ValueList({"Canto": 0, "MDP": 1}, selected="Canto")
rh_in_02_3_canto_trasero = ValueList({"Canto": 0, "MDP": 1}, selected="Canto")
rh_in_02_4canto_izquierdo_arriba = ValueList({"Canto": 0, "MDP": 1}, selected="Canto")
rh_in_02_5_canto_derecho_abajo = ValueList({"Canto": 0, "MDP": 1}, selected="Canto")
segmentacion = ValueList({"Triángulos": 0, "Quads y triángulos (mixto)": 1, "Sólo quads si es posible": 2}, selected="Sólo quads si es posible")
rh_in_02_0_mapeado = ValueList({"Longitudinal": 0, "Atravesada": 1}, selected="Longitudinal")

# ----
unit_z_4 = UnitZ(Factor=rh_in_08_20_altura_division_izquierda)
expression = Expression(x=rh_in_08_20_altura_division_izquierda, Expression="if(x=100,0,if(x>100,1,\"\"))")

# ---- group: Costado Derecho
unit_z_5 = UnitZ(Factor=rh_in_06_20_altura_costado_derecho)
expression_2 = Expression(x=rh_in_06_20_altura_costado_derecho, Expression="if(x=100,0,if(x>100,1,\"\"))")

# ----
unit_z_6 = UnitZ(Factor=rh_in_07_20_altura_division_central)
expression_3 = Expression(x=rh_in_07_20_altura_division_central, Expression="if(x=100,0,if(x>100,1,\"\"))")

# ---- group: Costado Izquierdo
unit_z_7 = UnitZ(Factor=rh_in_05_20_altura_costado_izquierdo)
expression_4 = Expression(x=rh_in_05_20_altura_costado_izquierdo, Expression="if(x=100,0,if(x>100,1,\"\"))")

# ---- group: Division Media Izquierda
unit_z_8 = UnitZ(Factor=rh_in_10_20_altura_division_media_izquie)
expression_5 = Expression(x=rh_in_10_20_altura_division_media_izquie, Expression="if(x=100,0,if(x>100,1,\"\"))")
unit_y_2 = UnitY(Factor="32")

# ---- group: Division Media Derecha
unit_z_9 = UnitZ(Factor=rh_in_12_20_altura_division_media_derech)
expression_6 = Expression(x=rh_in_12_20_altura_division_media_derech, Expression="if(x=100,0,if(x>100,1,\"\"))")

# ----
unit_z_10 = UnitZ(Factor=rh_in_09_20_altura_division_derecha)
expression_7 = Expression(x=rh_in_09_20_altura_division_derecha, Expression="if(x=100,0,if(x>100,1,\"\"))")

# ---- group: Division Media
unit_z_11 = UnitZ(Factor=rh_in_11_20_altura_division_media)
expression_8 = Expression(x=rh_in_11_20_altura_division_media, Expression="if(x=100,0,if(x>100,1,\"\"))")

# ---- group: Tablero Inferior
rh_in_04_1_lado_balance = ValueList({"Cara A", "Cara B", "D/D"}, selected="Cara B")
rh_in_04_2_canto_frontal = ValueList({"Canto": 0, "MDP": 1}, selected="Canto")
rh_in_04_3_canto_trasero = ValueList({"Canto": 0, "MDP": 1}, selected="MDP")
rh_in_04_4canto_izquierdo_arriba = ValueList({"Canto": 0, "MDP": 1}, selected="Canto")
rh_in_04_5_canto_derecho_abajo = ValueList({"Canto": 0, "MDP": 1}, selected="Canto")
rh_in_04_7_eliminar_tablero_inferior = ValueList({"No": "0", "Si": "1"}, selected="No")
rh_in_04_6_tipo_pata = ValueList({"Pata Conica": "40", "Pata Cilindrica": "10", "Es de Colgar": "0"}, selected="Pata Conica")
segmentacion_2 = ValueList({"Triángulos": 0, "Quads y triángulos (mixto)": 1, "Sólo quads si es posible": 2}, selected="Sólo quads si es posible")
rh_in_04_0_mapeado = ValueList({"Longitudinal": 0, "Atravesada": 1}, selected="Longitudinal")

# ---- group: Dimensiones Generales (continued)
subtraction = Subtraction(A=rh_in_01_2_altura, B=rh_in_04_6_tipo_pata)
unit_z_12 = UnitZ(Factor=rh_in_04_6_tipo_pata)
domain_box = DomainBox(Base=PlaneXY(0, 0, 0), X=rh_in_01_0_ancho, Y=rh_in_01_1_profundidad, Z=subtraction)
move = Move(Geometry=domain_box, Motion=unit_z_12)  # -> Geometry, Transform
area = Area(Geometry=move.Geometry)  # -> Area, Centroid
yz_plane = YZPlane(Origin=area.Centroid)

# ----
deconstruct_brep = DeconstructBrep(Brep=move.Geometry)  # -> Faces, Edges, Vertices
list_item = ListItem(List=deconstruct_brep.Vertices, Index=panel_2, Wrap=True)
list_item_2 = ListItem(List=deconstruct_brep.Vertices, Index="2", Wrap=True)
move_2 = Move(Geometry=list_item, Motion=unit_z)  # -> Geometry, Transform
box_2pt = Box2Pt(PointA=move_2.Geometry, PointB=list_item_2, Plane=PlaneXY(0, 0, 0))
stream_filter = StreamFilter(Gate=rh_in_04_7_eliminar_tablero_inferior, Stream0=box_2pt)
area_2 = Area(Geometry=stream_filter)  # -> Area, Centroid
yz_plane_2 = YZPlane(Origin=area_2.Centroid)
xz_plane = XZPlane(Origin=area_2.Centroid)
deconstruct_brep_2 = DeconstructBrep(Brep=box_2pt)  # -> Faces, Edges, Vertices

expression_9 = Expression(x=rh_in_04_7_eliminar_tablero_inferior, Expression="if(x=\"1\",-15,\"\")")
panel_8 = Panel(expression_9)
expression_10 = Expression(x=rh_in_04_6_tipo_pata, Expression="if (x=\"40\",0,if(x=\"10\",1,if(x=\"0\",2,\"\")))")
panel_9 = Panel(expression_10)

list_item_3 = ListItem(List=deconstruct_brep_2.Vertices, Index="4", Wrap=True)
list_item_4 = ListItem(List=deconstruct_brep_2.Vertices, Index="0", Wrap=True)
move_3 = Move(Geometry=list_item_3, Motion=unit_x)  # -> Geometry, Transform
move_4 = Move(Geometry=list_item_4, Motion=unit_x_2)  # -> Geometry, Transform
move_5 = Move(Geometry=move_4.Geometry, Motion=unit_y)  # -> Geometry, Transform

vector_2pt = Vector2Pt(PointA=point_2, PointB=move_5.Geometry, Unitize=False)  # -> Vector, Length
move_6 = Move(Geometry=[brep_2, mesh_brep_2], Motion=vector_2pt.Vector)  # -> Geometry, Transform

vector_2pt_2 = Vector2Pt(PointA=point, PointB=move_5.Geometry, Unitize=False)  # -> Vector, Length
move_7 = Move(Geometry=[mesh_brep, brep], Motion=vector_2pt_2.Vector)  # -> Geometry, Transform

mirror = Mirror(Geometry=move_7.Geometry, Plane=yz_plane_2)  # -> Geometry, Transform

list_item_5 = ListItem(List=deconstruct_brep.Vertices, Index="4", Wrap=True)
list_item_6 = ListItem(List=deconstruct_brep.Vertices, Index=panel_7, Wrap=True)
move_8 = Move(Geometry=list_item_5, Motion=unit_z_3)  # -> Geometry, Transform
box_2pt_2 = Box2Pt(PointA=move_8.Geometry, PointB=list_item_6, Plane=PlaneXY(0, 0, 0))
deconstruct_brep_3 = DeconstructBrep(Brep=box_2pt_2)  # -> Faces, Edges, Vertices
list_item_7 = ListItem(List=deconstruct_brep_3.Vertices, Index="3", Wrap=True)
move_9 = Move(Geometry=list_item_7, Motion=unit_x_3)  # -> Geometry, Transform

mirror_2 = Mirror(Geometry=move_7.Geometry, Plane=xz_plane)  # -> Geometry, Transform
mirror_3 = Mirror(Geometry=move_6.Geometry, Plane=xz_plane)  # -> Geometry, Transform
mirror_4 = Mirror(Geometry=[mirror_3.Geometry, move_6.Geometry], Plane=yz_plane_2)  # -> Geometry, Transform
mirror_5 = Mirror(Geometry=[move_7.Geometry, mirror_2.Geometry], Plane=yz_plane_2)  # -> Geometry, Transform

# ---- group: Costado Izquierdo (continued)
box_2pt_3 = Box2Pt(PointA=move_3.Geometry, PointB=move_9.Geometry, Plane=PlaneXY(0, 0, 0))
deconstruct_brep_4 = DeconstructBrep(Brep=box_2pt_3)  # -> Faces, Edges, Vertices
list_item_8 = ListItem(List=deconstruct_brep_4.Vertices, Index="2", Wrap=True)
move_10 = Move(Geometry=list_item_8, Motion=unit_z_7)  # -> Geometry, Transform
box_2pt_4 = Box2Pt(PointA=move_3.Geometry, PointB=move_10.Geometry, Plane=PlaneXY(0, 0, 0))
stream_filter_2 = StreamFilter(Gate=expression_4, Stream0=box_2pt_3, Stream1=box_2pt_4)

# ----
cluster = Cluster_6(
    posicion_externos_superior=rh_in_05_7_posicion,
    posicion_internos_superior=rh_in_05_10_posicion,
    relay=stream_filter_2,
    posicion_externos_inferior=rh_in_05_14_posicion,
    posicion_internos_inferior=rh_in_05_17_posicion)  # -> punto_de_simetria_superior, punto_0_externos_superior, punto_0_internos_superior, punto_de_simetria_inferior, punto_0_externos_inferior, punto_0_internos_inferior
cluster_2 = Cluster_2(
    sujecion_inferior_herraje=rh_in_05_13_sujecion_inferior_herraje_ex,
    cambiar_lado=rh_in_05_19_cambiar_lado,
    punto_0_internos=cluster.punto_0_externos_inferior)  # -> punto_0_internos_2, punto_tuerca, mecanizados
cluster_3 = Cluster_2(
    sujecion_inferior_herraje=rh_in_05_16_sujecion_inferior_herraje_in,
    cambiar_lado=rh_in_05_19_cambiar_lado,
    punto_0_internos=cluster.punto_0_internos_inferior)  # -> punto_0_internos_2, punto_tuerca, mecanizados
cluster_4 = Cluster_3(
    sujecion_inferior_herraje=rh_in_05_6_sujecion_superior_externo,
    cambiar_lado=rh_in_05_12_cambiar_lado,
    punto_0_internos=cluster.punto_0_externos_superior)  # -> punto_0_externos, punto_tuerca, mecanizados
cluster_5 = Cluster_5(
    sujecion_inferior_herraje=rh_in_05_9_sujecion_superior_interno,
    cambiar_lado=rh_in_05_12_cambiar_lado,
    punto_0_internos=cluster.punto_0_internos_superior)  # -> punto_0_internos_2, punto_tuerca, mecanizados
cluster_6 = Cluster(
    sujecion_herrajes=rh_in_05_13_sujecion_inferior_herraje_ex,
    simetria=rh_in_05_15_simetria,
    cambiar_lado=rh_in_05_19_cambiar_lado,
    mecanizados=cluster_2.mecanizados,
    punto_simetria=cluster.punto_de_simetria_inferior,
    punto_0=cluster_2.punto_0_internos_2,
    punto_tuerca=cluster_2.punto_tuerca)  # -> mecanizados_2, tarugo, caja_minifix, minifix_de_presion, minifix_roscado, tornillo_largo, tornillo_pt, tuerca
cluster_7 = Cluster(
    sujecion_herrajes=rh_in_05_16_sujecion_inferior_herraje_in,
    simetria=rh_in_05_18_simetria,
    cambiar_lado=rh_in_05_19_cambiar_lado,
    mecanizados=cluster_3.mecanizados,
    punto_simetria=cluster.punto_de_simetria_inferior,
    punto_0=cluster_3.punto_0_internos_2,
    punto_tuerca=cluster_3.punto_tuerca)  # -> mecanizados_2, tarugo, caja_minifix, minifix_de_presion, minifix_roscado, tornillo_largo, tornillo_pt, tuerca
cluster_8 = Cluster_4(
    sujecion_herrajes=rh_in_05_6_sujecion_superior_externo,
    simetria=rh_in_05_8_simetria,
    cambiar_lado=rh_in_05_12_cambiar_lado,
    mecanizados=cluster_4.mecanizados,
    punto_simetria=cluster.punto_de_simetria_superior,
    punto_0=cluster_4.punto_0_externos,
    punto_tuerca=cluster_4.punto_tuerca)  # -> mecanizados_2, tarugo, caja_minifix, minifix_de_presion, minifix_roscado, tornillo_largo, tornillo_pt, tuerca
cluster_9 = Cluster_4(
    sujecion_herrajes=rh_in_05_9_sujecion_superior_interno,
    simetria=rh_in_05_8_simetria,
    cambiar_lado=rh_in_05_12_cambiar_lado,
    mecanizados=cluster_5.mecanizados,
    punto_simetria=cluster.punto_de_simetria_superior,
    punto_0=cluster_5.punto_0_internos_2,
    punto_tuerca=cluster_5.punto_tuerca)  # -> mecanizados_2, tarugo, caja_minifix, minifix_de_presion, minifix_roscado, tornillo_largo, tornillo_pt, tuerca

solid_difference = SolidDifference(BrepsA=box_2pt_2, Perforados=flatten([cluster_8.mecanizados_2, cluster_9.mecanizados_2]))

# ---- group: Tablero Superior
# Materializer 3.4
python_3_script = Python3Script(
    Brep_In=solid_difference,
    Balance_Mode=rh_in_02_1_lado_balance,
    Canto_1=rh_in_02_2_canto_frontal,
    Canto_2=rh_in_02_3_canto_trasero,
    Canto_3=rh_in_02_4canto_izquierdo_arriba,
    Canto_4=rh_in_02_5_canto_derecho_abajo)  # -> Out, NURBS_Color, NURBS_Balance, NURBS_MDP; inputs Brep_In: Brep, Balance_Mode: String, Canto_1: String, Canto_2: String, Canto_3: String, Canto_4: String
# ---------- python_3_script: Python ----------
"""
=============================================================================
PROYECTO:      3dBimFab
COMPONENTE:    3dBimFab - Desglosador DfMA de Pieza Real NURBS (Materializer)
VERSIÓN:       3.4 DfMA Inteligencia Total (Simetría Dual + Cierre de Ranuras)
AUTOR:         Mario Mojica & Gamma (3dBimFab Digital Manufacturing Engine)
DESCRIPCIÓN:   Clasifica geométricamente las caras de piezas NURBS / Breps en:
               - Caras Principales (A = Exterior / B = Interior) con auto-detección
                 de simetría (por centroide relativo Xmid y por presencia de ranura).
               - Cantos Perimetrales (1 a 4) planos o chaflanes a 45°.
               - Mecanizados y Ranuras (SIEMPRE a MDP, sin descartar ninguna cara).
               - 100% compatible con Item Access o List Access en Grasshopper.
=============================================================================
"""

import Rhino

def parse_balance(val):
    s = str(val).lower().strip().replace('"', '').replace("'", "")
    if s in ["6", "d/d", "dyd", "doble", "ninguno", "ambas"] or "d/d" in s or "dyd" in s:
        return "DD"
    if s in ["5", "cara a", "a"] or (s.startswith("a") and len(s) <= 6):
        return "A"
    if s in ["4", "cara b", "b"] or (s.startswith("b") and len(s) <= 6):
        return "B"
    if "ambos" in s:
        return "AMBOS"
    return "B"

def parse_canto(val):
    s = str(val).lower().strip().replace('"', '').replace("'", "")
    if s in ["0", "0.0", "canto", "true", "si", "sí", "con canto"] or ("canto" in s and "sin" not in s):
        return True # Madera / Color
    if s in ["1", "1.0", "mdp", "false", "no", "sin canto"] or "mdp" in s or "sin" in s:
        return False # Crudo / MDP
    return True

def clasificar_brep_individual(brep_in, balance_mode="Cara B", c1="Canto", c2="Canto", c3="Canto", c4="Canto", is_left=None):
    if brep_in is None:
        return [], [], [], "Aviso: Brep nulo"

    bbox = brep_in.GetBoundingBox(True)
    x0, x1 = bbox.Min.X, bbox.Max.X
    y0, y1 = bbox.Min.Y, bbox.Max.Y
    z0, z1 = bbox.Min.Z, bbox.Max.Z

    sx = max(0.1, x1 - x0)
    sy = max(0.1, y1 - y0)
    sz = max(0.1, z1 - z0)
    min_dim = min(sx, sy, sz)

    # Tolerancia geométrica adaptativa (invariante a escala metros/milímetros)
    tol = max(0.0002, min_dim * 0.15)
    zona_bisel = min_dim * 2.2

    # Detección anatómica de simetría si is_left no vino definido externamente
    if is_left is None and min_dim == sx:
        count_x0 = 0
        count_x1 = 0
        for i in range(brep_in.Faces.Count):
            f = brep_in.Faces[i]
            if f.IsPlanar():
                u = (f.Domain(0).T0 + f.Domain(0).T1) * 0.5
                v = (f.Domain(1).T0 + f.Domain(1).T1) * 0.5
                pt = f.PointAt(u, v)
                n = f.NormalAt(u, v)
                n.Unitize()
                if n.X < -0.85 and abs(pt.X - x0) < tol:
                    count_x0 += 1
                elif n.X > 0.85 and abs(pt.X - x1) < tol:
                    count_x1 += 1
        
        # En un lateral de cajón, el lado interior tiene al menos 2 caras por la ranura (arriba y abajo)
        # mientras que el lado exterior es 1 sola cara continua.
        if count_x1 > count_x0:
            # Más caras en +X (ranura interior hacia +X) -> Lateral Izquierdo
            is_left = True
        elif count_x0 > count_x1:
            # Más caras en -X (ranura interior hacia -X) -> Lateral Derecho
            is_left = False
        else:
            xc = (x0 + x1) * 0.5
            is_left = (xc < 0)

    faces_A = []
    faces_B = []
    faces_cantos = {1: [], 2: [], 3: [], 4: []}
    faces_mecanizados = []

    for i in range(brep_in.Faces.Count):
        f = brep_in.Faces[i]
        nurbs_face = f.DuplicateFace(False)

        if not f.IsPlanar():
            faces_mecanizados.append(nurbs_face)
            continue

        u = (f.Domain(0).T0 + f.Domain(0).T1) * 0.5
        v = (f.Domain(1).T0 + f.Domain(1).T1) * 0.5
        pt = f.PointAt(u, v)
        n = f.NormalAt(u, v)
        n.Unitize()

        # -----------------------------------------------------------------
        # CASO 1: Tablero Horizontal (Cubiertas / Entrepaños / Fondos cajón - Espesor en Z)
        # -----------------------------------------------------------------
        if min_dim == sz:
            tipo_str = "Horizontal (Cubierta/Entrepaño/Fondo)"
            if n.Z > 0.85 and abs(pt.Z - z1) < tol:
                faces_A.append(nurbs_face)
            elif n.Z < -0.85 and abs(pt.Z - z0) < tol:
                faces_B.append(nurbs_face)
            # Canto 1: Frontal (-Y)
            elif (n.Y < -0.85 and abs(pt.Y - y0) < tol) or (-0.85 < n.Y < -0.30 and (pt.Y - y0) < zona_bisel and abs(pt.Z - ((z0+z1)*0.5)) < (sz * 0.6)):
                faces_cantos[1].append(nurbs_face)
            # Canto 2: Trasero (+Y)
            elif (n.Y > 0.85 and abs(pt.Y - y1) < tol) or (0.30 < n.Y < 0.85 and (y1 - pt.Y) < zona_bisel and abs(pt.Z - ((z0+z1)*0.5)) < (sz * 0.6)):
                faces_cantos[2].append(nurbs_face)
            # Canto 3: Izquierdo (-X)
            elif (n.X < -0.85 and abs(pt.X - x0) < tol) or (-0.85 < n.X < -0.30 and (pt.X - x0) < zona_bisel and abs(pt.Z - ((z0+z1)*0.5)) < (sz * 0.6)):
                faces_cantos[3].append(nurbs_face)
            # Canto 4: Derecho (+X)
            elif (n.X > 0.85 and abs(pt.X - x1) < tol) or (0.30 < n.X < 0.85 and (x1 - pt.X) < zona_bisel and abs(pt.Z - ((z0+z1)*0.5)) < (sz * 0.6)):
                faces_cantos[4].append(nurbs_face)
            else:
                faces_mecanizados.append(nurbs_face)

        # -----------------------------------------------------------------
        # CASO 2: Tablero Vertical Lateral (Costados / Laterales Cajón - Espesor en X)
        # -----------------------------------------------------------------
        elif min_dim == sx:
            tipo_str = "Vertical Lateral (Costado/Lateral Cajón {})".format("IZQ" if is_left else "DER")
            
            # Detectar caras límites exteriores en x0 (-X) y x1 (+X)
            # En un lateral con ranura, la cara interior está dividida por la ranura (>= 2 caras)
            # y la cara exterior es una sola cara continua (1 cara).
            faces_x0 = []
            faces_x1 = []
            
            # Cantos y mecanizados se van clasificando
            for f_idx in range(brep_in.Faces.Count):
                f_cur = brep_in.Faces[f_idx]
                n_face = f_cur.DuplicateFace(False)
                if not f_cur.IsPlanar():
                    faces_mecanizados.append(n_face)
                    continue
                u = (f_cur.Domain(0).T0 + f_cur.Domain(0).T1) * 0.5
                v = (f_cur.Domain(1).T0 + f_cur.Domain(1).T1) * 0.5
                pt = f_cur.PointAt(u, v)
                n = f_cur.NormalAt(u, v)
                n.Unitize()
                
                if n.X < -0.85 and abs(pt.X - x0) < tol:
                    faces_x0.append(n_face)
                elif n.X > 0.85 and abs(pt.X - x1) < tol:
                    faces_x1.append(n_face)
                elif (n.Y < -0.85 and abs(pt.Y - y0) < tol) or (-0.85 < n.Y < -0.30 and (pt.Y - y0) < zona_bisel and abs(pt.X - ((x0+x1)*0.5)) < (sx * 0.6)):
                    faces_cantos[1].append(n_face)
                elif (n.Y > 0.85 and abs(pt.Y - y1) < tol) or (0.30 < n.Y < 0.85 and (y1 - pt.Y) < zona_bisel and abs(pt.X - ((x0+x1)*0.5)) < (sx * 0.6)):
                    faces_cantos[2].append(n_face)
                elif (n.Z > 0.85 and abs(pt.Z - z1) < tol) or (0.30 < n.Z < 0.85 and (z1 - pt.Z) < zona_bisel and abs(pt.X - ((x0+x1)*0.5)) < (sx * 0.6)):
                    faces_cantos[3].append(n_face)
                elif (n.Z < -0.85 and abs(pt.Z - z0) < tol) or (-0.85 < n.Z < -0.30 and (pt.Z - z0) < zona_bisel and abs(pt.X - ((x0+x1)*0.5)) < (sx * 0.6)):
                    faces_cantos[4].append(n_face)
                else:
                    faces_mecanizados.append(n_face)
            
            # Asignación DfMA infalible:
            # Cara B = Siempre Interior (con ranura)
            # Cara A = Siempre Exterior (lisa continua)
            if len(faces_x1) > len(faces_x0):
                # Interior está en +X (Lateral Izquierdo)
                faces_A.extend(faces_x0)
                faces_B.extend(faces_x1)
            elif len(faces_x0) > len(faces_x1):
                # Interior está en -X (Lateral Derecho)
                faces_A.extend(faces_x1)
                faces_B.extend(faces_x0)
            else:
                # Si son iguales (sin ranura), usar is_left
                if is_left:
                    faces_A.extend(faces_x0)
                    faces_B.extend(faces_x1)
                else:
                    faces_A.extend(faces_x1)
                    faces_B.extend(faces_x0)
            
            # Saltamos el bucle individual ya que procesamos todas las caras de este Brep
            break

        # -----------------------------------------------------------------
        # CASO 3: Tablero Vertical Frontal (Frentes / Traseras Cajón / Puertas / Zócalos - Espesor en Y)
        # -----------------------------------------------------------------
        else:
            tipo_str = "Vertical Frontal (Frente/Trasera/Puerta)"
            if n.Y < -0.85 and abs(pt.Y - y0) < tol:
                faces_A.append(nurbs_face)
            elif n.Y > 0.85 and abs(pt.Y - y1) < tol:
                faces_B.append(nurbs_face)
            # Canto 1: Superior (+Z)
            elif (n.Z > 0.85 and abs(pt.Z - z1) < tol) or (0.30 < n.Z < 0.85 and (z1 - pt.Z) < zona_bisel and abs(pt.Y - ((y0+y1)*0.5)) < (sy * 0.6)):
                faces_cantos[1].append(nurbs_face)
            # Canto 2: Inferior (-Z)
            elif (n.Z < -0.85 and abs(pt.Z - z0) < tol) or (-0.85 < n.Z < -0.30 and (pt.Z - z0) < zona_bisel and abs(pt.Y - ((y0+y1)*0.5)) < (sy * 0.6)):
                faces_cantos[2].append(nurbs_face)
            # Canto 3: Izquierdo (-X)
            elif (n.X < -0.85 and abs(pt.X - x0) < tol) or (-0.85 < n.X < -0.30 and (pt.X - x0) < zona_bisel and abs(pt.Y - ((y0+y1)*0.5)) < (sy * 0.6)):
                faces_cantos[3].append(nurbs_face)
            # Canto 4: Derecho (+X)
            elif (n.X > 0.85 and abs(pt.X - x1) < tol) or (0.30 < n.X < 0.85 and (x1 - pt.X) < zona_bisel and abs(pt.Y - ((y0+y1)*0.5)) < (sy * 0.6)):
                faces_cantos[4].append(nurbs_face)
            else:
                faces_mecanizados.append(nurbs_face)

    # 3. Asignación de Caras Principales según Balance
    modo_b = parse_balance(balance_mode)
    nurbs_color = []
    nurbs_balance = []
    nurbs_mdp = []

    if modo_b == "DD":
        nurbs_color.extend(faces_A)
        nurbs_color.extend(faces_B)
        diag_bal = "D/D (Doble Cara Madera)"
    elif modo_b == "A":
        nurbs_balance.extend(faces_A)
        nurbs_color.extend(faces_B)
        diag_bal = "Balance en Cara A (Exterior)"
    elif modo_b == "B":
        nurbs_color.extend(faces_A)
        nurbs_balance.extend(faces_B)
        diag_bal = "Balance en Cara B (Interior)"
    else:
        nurbs_balance.extend(faces_A)
        nurbs_balance.extend(faces_B)
        diag_bal = "Ambas Caras Balance"

    # 4. Asignación de Cantos
    cantos_in = {
        1: parse_canto(c1),
        2: parse_canto(c2),
        3: parse_canto(c3),
        4: parse_canto(c4)
    }

    for num_canto, tiene_canto in cantos_in.items():
        if tiene_canto:
            nurbs_color.extend(faces_cantos[num_canto])
        else:
            nurbs_mdp.extend(faces_cantos[num_canto])

    # 5. Mecanizados y barrenos siempre van a MDP
    nurbs_mdp.extend(faces_mecanizados)

    diag = "{0} | {1} | Caras: {2} (A={3}, B={4}, Cantos={5}, Mec={6})".format(
        tipo_str, diag_bal, brep_in.Faces.Count,
        len(faces_A), len(faces_B), sum(len(v) for v in faces_cantos.values()), len(faces_mecanizados)
    )

    return nurbs_color, nurbs_balance, nurbs_mdp, diag

def ejecutar_materializer_dfma(brep_input, b_mode, c1, c2, c3, c4):
    if brep_input is None:
        return [], [], [], "Brep nulo"

    if hasattr(brep_input, "__iter__") and not hasattr(brep_input, "Faces"):
        breps = [b for b in brep_input if b is not None]
    else:
        breps = [brep_input]

    if not breps:
        return [], [], [], "Lista de Breps vacía"

    is_left_flags = [None] * len(breps)
    if len(breps) > 1:
        bboxes = []
        for b in breps:
            bb = b.GetBoundingBox(True)
            bboxes.append({
                "xc": (bb.Min.X + bb.Max.X) * 0.5,
                "yc": (bb.Min.Y + bb.Max.Y) * 0.5,
                "zc": (bb.Min.Z + bb.Max.Z) * 0.5,
                "sx": bb.Max.X - bb.Min.X,
                "sy": bb.Max.Y - bb.Min.Y,
                "sz": bb.Max.Z - bb.Min.Z
            })

        # Calcular X_min y X_max global del grupo de laterales (funciona en metros y milímetros)
        xs = [info["xc"] for info in bboxes if min(info["sx"], info["sy"], info["sz"]) == info["sx"]]
        if len(xs) >= 2 and (max(xs) - min(xs)) > 0.05:
            mid_x_global = (min(xs) + max(xs)) * 0.5
            for i, info in enumerate(bboxes):
                if min(info["sx"], info["sy"], info["sz"]) == info["sx"]:
                    is_left_flags[i] = (info["xc"] < mid_x_global)

    all_col = []
    all_bal = []
    all_mdp = []
    diag_lines = []

    for idx, b in enumerate(breps):
        flag = is_left_flags[idx]
        col, bal, mdp, diag = clasificar_brep_individual(b, b_mode, c1, c2, c3, c4, is_left=flag)
        all_col.extend(col)
        all_bal.extend(bal)
        all_mdp.extend(mdp)
        diag_lines.append("P{0}: {1}".format(idx+1, diag))

    res_diag = " | ".join(diag_lines) if len(diag_lines) <= 3 else "{0} piezas procesadas DfMA. {1}".format(len(breps), diag_lines[0])
    return all_col, all_bal, all_mdp, res_diag

# =============================================================================
# EJECUCIÓN GRASSHOPPER
# =============================================================================
_b_mode = Balance_Mode if 'Balance_Mode' in locals() and Balance_Mode is not None else "Cara B"
_c1 = Canto_1 if 'Canto_1' in locals() and Canto_1 is not None else "Canto"
_c2 = Canto_2 if 'Canto_2' in locals() and Canto_2 is not None else "Canto"
_c3 = Canto_3 if 'Canto_3' in locals() and Canto_3 is not None else "Canto"
_c4 = Canto_4 if 'Canto_4' in locals() and Canto_4 is not None else "Canto"

NURBS_Color, NURBS_Balance, NURBS_MDP, Out = ejecutar_materializer_dfma(
    Brep_In, _b_mode, _c1, _c2, _c3, _c4
)

out = Out
a = Out
Info_Pieza = Out
print(Out)
# ---------- end python_3_script ----------

# ---- group: Costado Izquierdo (continued)
solid_difference_2 = SolidDifference(
    BrepsA=stream_filter_2,
    BrepsB=flatten([cluster_7.mecanizados_2, cluster_6.mecanizados_2, cluster_9.mecanizados_2, cluster_8.mecanizados_2]))

# ----
solid_difference_3 = SolidDifference(BrepsA=stream_filter, Perforados=flatten([cluster_7.mecanizados_2, cluster_6.mecanizados_2]))

# ---- group: Tablero Inferior
# Materializer 3.4
python_3_script_2 = Python3Script(
    Brep_In=solid_difference_3,
    Balance_Mode=rh_in_04_1_lado_balance,
    Canto_1=rh_in_04_2_canto_frontal,
    Canto_2=rh_in_04_3_canto_trasero,
    Canto_3=rh_in_04_4canto_izquierdo_arriba,
    Canto_4=rh_in_04_5_canto_derecho_abajo)  # -> Out, NURBS_Color, NURBS_Balance, NURBS_MDP; inputs Brep_In: Brep, Balance_Mode: String, Canto_1: String, Canto_2: String, Canto_3: String, Canto_4: String; same code as python_3_script

# ---- group: Divisiones (continued)
deconstruct_brep_5 = DeconstructBrep(Brep=box_2pt_3)  # -> Faces, Edges, Vertices
list_item_9 = ListItem(List=deconstruct_brep_5.Edges, Index="2", Wrap=True)
curve_middle = CurveMiddle(Curve=list_item_9)

# ---- group: Tablero Superior (continued)
diagnostico = Panel(python_3_script.Out)
mesh_brep_3 = MeshBrep(
    Brep=python_3_script.NURBS_Color,
    Settings={GridMaxCount=0, GridMinCount=16, JaggedSeams=False, MaxEdgeLength=0, MinEdgeLength=0.0001, MinTolerance=0, Refine=True, RefineAngle=0, RelativeTolerance=0.65, SimplePlanes=True, Tolerance=0})
mesh_brep_4 = MeshBrep(
    Brep=python_3_script.NURBS_Balance,
    Settings={GridMaxCount=0, GridMinCount=16, JaggedSeams=False, MaxEdgeLength=0, MinEdgeLength=0.0001, MinTolerance=0, Refine=True, RefineAngle=0, RelativeTolerance=0.65, SimplePlanes=True, Tolerance=0})
mesh_brep_5 = MeshBrep(
    Brep=python_3_script.NURBS_MDP,
    Settings={GridMaxCount=0, GridMinCount=16, JaggedSeams=False, MaxEdgeLength=0, MinEdgeLength=0.0001, MinTolerance=0, Refine=True, RefineAngle=0, RelativeTolerance=0.65, SimplePlanes=True, Tolerance=0})
mesh_join = MeshJoin(Meshes=flatten(mesh_brep_3))
mesh_join_2 = MeshJoin(Meshes=flatten(mesh_brep_4))
mesh_join_3 = MeshJoin(Meshes=flatten(mesh_brep_5))
reduce_mesh = ReduceMesh(Mesh=mesh_join_3, FaceCount=20, Accuracy=1, FaceType=segmentacion, Distort=Toggle(False), Normalize=Toggle(True))  # -> Reduced, CountDifference
panel_10 = Panel(reduce_mesh.CountDifference)
python_3_script_3 = Python3Script(M=reduce_mesh.Reduced, B=rh_in_02_0_mapeado)  # -> a; inputs M: Mesh, B: list of Int32
# ---------- python_3_script_3: Python ----------
"""
=============================================================================
PROYECTO:      3dBimFab
COMPONENTE:    3dBimFab - Box Mapping UV Métrico Cohesivo (600mm)
VERSIÓN:       v3.8 - DfMA Anatómico Granular & Cantos Siempre Longitudinales
AUTOR:         Mario Mojica & Gamma (3dBimFab Digital Manufacturing Engine)
DESCRIPCIÓN:   Mapeado métrico de 600 mm para piezas de taller y sólidos DWG:
               - La imagen tiene su veta de izquierda a derecha (Eje U).
               - Descompone mallas unidas (SplitDisjointPieces) para medir
                 las dimensiones físicas reales de cada pieza individual.
               - En Laterales de Cajón (sy > sz): veta corre a lo largo del cajón (Y).
               - En Costados de Mueble (sz >= sy): veta corre en altura vertical (Z).
               - En Cubiertas y Frentes: veta corre longitudinal a lo largo de X.
               - Cantos perimetrales: SIEMPRE longitudinales a su propio filo.
=============================================================================
"""

import Rhino

def extraer_valor_b(val):
    if val is None:
        return False
    while isinstance(val, (list, tuple)) and len(val) > 0:
        val = val[0]
    if hasattr(val, "Value"):
        val = val.Value
    
    s = str(val).lower().strip().replace('"', '').replace("'", "")
    return "atravesad" in s or s in ["1", "1.0", "true", "si", "sí", "3", "5"]

def _mapear_mesh_simple(mesh_in, modo_veta, escala_caja_mm=600.0):
    if mesh_in is None:
        return mesh_in

    mesh = mesh_in.DuplicateMesh() if hasattr(mesh_in, "DuplicateMesh") else mesh_in
    mesh.Normals.ComputeNormals()
    mesh.TextureCoordinates.Clear()

    bbox = mesh.GetBoundingBox(True)
    sx = max(0.001, bbox.Max.X - bbox.Min.X)
    sy = max(0.001, bbox.Max.Y - bbox.Min.Y)
    sz = max(0.001, bbox.Max.Z - bbox.Min.Z)

    min_dim = min(sx, sy, sz)
    es_atravesada = extraer_valor_b(modo_veta)
    escala = float(escala_caja_mm)

    for idx in range(mesh.Vertices.Count):
        v = mesh.Vertices[idx]
        n = mesh.Normals[idx] if idx < mesh.Normals.Count else Rhino.Geometry.Vector3f(0, 0, 1)

        lx = v.X - bbox.Min.X
        ly = v.Y - bbox.Min.Y
        lz = v.Z - bbox.Min.Z

        nx, ny, nz = abs(n.X), abs(n.Y), abs(n.Z)

        # -------------------------------------------------------------
        # CASO 1: Tablero Horizontal (Cubiertas, Entrepaños - Espesor en Z)
        # -------------------------------------------------------------
        if min_dim == sz:
            if nz >= nx and nz >= ny:
                # Cara principal (plano XY)
                u = ly / escala if es_atravesada else lx / escala
                v_coord = lx / escala if es_atravesada else ly / escala
            elif ny >= nx and ny >= nz:
                # Cantos frontal y trasero (en Y): veta longitudinal al filo (en X)
                u = lx / escala
                v_coord = lz / escala
            else:
                # Cantos laterales (en X): veta longitudinal al filo (en Y)
                u = ly / escala
                v_coord = lz / escala

        # -------------------------------------------------------------
        # CASO 2: Tablero Vertical Lateral (Costados / Laterales Cajón - Espesor en X)
        # -------------------------------------------------------------
        elif min_dim == sx:
            if nx >= ny and nx >= nz:
                # Cara principal (plano YZ)
                if sz >= sy:
                    # Costado de Mueble (alto en Z): Longitudinal corre en Z
                    u = ly / escala if es_atravesada else lz / escala
                    v_coord = lz / escala if es_atravesada else ly / escala
                else:
                    # Lateral de Cajón (largo en Y): Longitudinal corre a lo largo del cajón (Y)
                    u = lz / escala if es_atravesada else ly / escala
                    v_coord = ly / escala if es_atravesada else lz / escala
            elif nz >= nx and nz >= ny:
                # Cantos superior e inferior (en Z): veta siempre longitudinal al filo (en Y)
                u = ly / escala
                v_coord = lx / escala
            else:
                # Cantos frontal y trasero (en Y): veta siempre longitudinal al filo (en Z)
                u = lz / escala
                v_coord = lx / escala

        # -------------------------------------------------------------
        # CASO 3: Tablero Vertical Frontal (Frentes, Zócalos - Espesor en Y)
        # -------------------------------------------------------------
        else:
            if ny >= nx and ny >= nz:
                # Cara principal (plano XZ): Longitudinal corre horizontal en X
                u = lz / escala if es_atravesada else lx / escala
                v_coord = lx / escala if es_atravesada else lz / escala
            elif nz >= nx and nz >= ny:
                # Cantos superior e inferior (en Z): veta longitudinal al filo (en X)
                u = lx / escala
                v_coord = ly / escala
            else:
                # Cantos laterales (en X): veta longitudinal al filo (en Z)
                u = lz / escala
                v_coord = ly / escala

        mesh.TextureCoordinates.Add(float(u), float(v_coord))

    return mesh

def aplicar_box_mapping_profesional(mesh_in, modo_veta=0, escala_caja_mm=600.0):
    if mesh_in is None or not isinstance(mesh_in, Rhino.Geometry.Mesh):
        return mesh_in

    if hasattr(mesh_in, "SplitDisjointPieces"):
        piezas = mesh_in.SplitDisjointPieces()
    else:
        piezas = [mesh_in]

    if len(piezas) > 1:
        mesh_out = Rhino.Geometry.Mesh()
        for p in piezas:
            p_mapped = _mapear_mesh_simple(p, modo_veta, escala_caja_mm)
            mesh_out.Append(p_mapped)
        return mesh_out
    else:
        return _mapear_mesh_simple(mesh_in, modo_veta, escala_caja_mm)

# =============================================================================
# INYECCIÓN Y EJECUCIÓN (Compatible con List Access en B)
# =============================================================================
val_b = B if 'B' in locals() and B is not None else 0

if isinstance(M, list):
    a = [aplicar_box_mapping_profesional(item, val_b, 600.0) for item in M if item is not None]
else:
    a = aplicar_box_mapping_profesional(M, val_b, 600.0)
# ---------- end python_3_script_3 ----------
python_3_script_4 = Python3Script(M=mesh_join_2, B=rh_in_02_0_mapeado)  # -> a; inputs M: Mesh, B: list of Int32; same code as python_3_script_3
rh_out_tablero_superior_b = Geometry(python_3_script_4)
rh_out_mdp_tablero_superior = Geometry(python_3_script_3)

# Box Mapping 3.8
python_3_script_5 = Python3Script(M=mesh_join, B=rh_in_02_0_mapeado)  # -> a; inputs M: Mesh, B: list of Int32; same code as python_3_script_3

rh_out_tablero_superior = Geometry(python_3_script_5)

# ---- group: Costado Derecho (continued)
mirror_6 = Mirror(Geometry=box_2pt_3, Plane=yz_plane)  # -> Geometry, Transform
deconstruct_brep_6 = DeconstructBrep(Brep=mirror_6.Geometry)  # -> Faces, Edges, Vertices
list_item_10 = ListItem(List=deconstruct_brep_6.Vertices, Index="5", Wrap=True)
list_item_11 = ListItem(List=deconstruct_brep_6.Vertices, Index="7", Wrap=True)
list_item_12 = ListItem(List=deconstruct_brep_6.Vertices, Index="3", Wrap=True)
box_2pt_5 = Box2Pt(PointA=list_item_10, PointB=list_item_12, Plane=PlaneXY(0, 0, 0))
move_11 = Move(Geometry=list_item_11, Motion=unit_z_5)  # -> Geometry, Transform
box_2pt_6 = Box2Pt(PointA=list_item_10, PointB=move_11.Geometry, Plane=PlaneXY(0, 0, 0))
stream_filter_3 = StreamFilter(Gate=expression_2, Stream0=box_2pt_5, Stream1=box_2pt_6)

# ---- group: Divisiones (continued)
deconstruct_brep_7 = DeconstructBrep(Brep=mirror_6.Geometry)  # -> Faces, Edges, Vertices
list_item_13 = ListItem(List=deconstruct_brep_7.Edges, Index=panel, Wrap=True)
curve_middle_2 = CurveMiddle(Curve=list_item_13)
distance = Distance(PointA=curve_middle, PointB=curve_middle_2)
division = Division(A=distance, B=rh_in_02_0_divisiones)
unit_x_4 = UnitX(Factor=division)
stream_gate = StreamGate(Segmentos=unit_x_4, Gate=rh_in_02_0_divisiones)  # -> Target0, Target1, Target2, Target3, Target4

# ----
cluster_10 = Cluster_6(
    posicion_externos_superior=rh_in_06_7_posicion,
    posicion_internos_superior=rh_in_06_10_posicion,
    relay=stream_filter_3,
    posicion_externos_inferior=rh_in_06_14_posicion,
    posicion_internos_inferior=rh_in_06_17_posicion)  # -> punto_de_simetria_superior, punto_0_externos_superior, punto_0_internos_superior, punto_de_simetria_inferior, punto_0_externos_inferior, punto_0_internos_inferior
cluster_11 = Cluster_2(
    sujecion_inferior_herraje=rh_in_06_13_sujecion_inferior_herraje_ex,
    cambiar_lado=rh_in_06_19_cambiar_lado,
    punto_0_internos=cluster_10.punto_0_externos_inferior)  # -> punto_0_internos_2, punto_tuerca, mecanizados
cluster_12 = Cluster_2(
    sujecion_inferior_herraje=rh_in_06_16_sujecion_inferior_herraje_in,
    cambiar_lado=rh_in_06_19_cambiar_lado,
    punto_0_internos=cluster_10.punto_0_internos_inferior)  # -> punto_0_internos_2, punto_tuerca, mecanizados
cluster_13 = Cluster_3(
    sujecion_inferior_herraje=rh_in_06_6_sujecion_superior_externo,
    cambiar_lado=rh_in_06_12_cambiar_lado,
    punto_0_internos=cluster_10.punto_0_externos_superior)  # -> punto_0_externos, punto_tuerca, mecanizados
cluster_14 = Cluster_5(
    sujecion_inferior_herraje=rh_in_06_9_sujecion_superior_interno,
    cambiar_lado=rh_in_06_12_cambiar_lado,
    punto_0_internos=cluster_10.punto_0_internos_superior)  # -> punto_0_internos_2, punto_tuerca, mecanizados
cluster_15 = Cluster(
    sujecion_herrajes=rh_in_06_13_sujecion_inferior_herraje_ex,
    simetria=rh_in_06_15_simetria,
    cambiar_lado=rh_in_06_19_cambiar_lado,
    mecanizados=cluster_11.mecanizados,
    punto_simetria=cluster_10.punto_de_simetria_inferior,
    punto_0=cluster_11.punto_0_internos_2,
    punto_tuerca=cluster_11.punto_tuerca)  # -> mecanizados_2, tarugo, caja_minifix, minifix_de_presion, minifix_roscado, tornillo_largo, tornillo_pt, tuerca
cluster_16 = Cluster(
    sujecion_herrajes=rh_in_06_16_sujecion_inferior_herraje_in,
    simetria=rh_in_06_18_simetria,
    cambiar_lado=rh_in_06_19_cambiar_lado,
    mecanizados=cluster_12.mecanizados,
    punto_simetria=cluster_10.punto_de_simetria_inferior,
    punto_0=cluster_12.punto_0_internos_2,
    punto_tuerca=cluster_12.punto_tuerca)  # -> mecanizados_2, tarugo, caja_minifix, minifix_de_presion, minifix_roscado, tornillo_largo, tornillo_pt, tuerca
cluster_17 = Cluster_4(
    sujecion_herrajes=rh_in_06_6_sujecion_superior_externo,
    simetria=rh_in_06_8_simetria,
    cambiar_lado=rh_in_06_12_cambiar_lado,
    mecanizados=cluster_13.mecanizados,
    punto_simetria=cluster_10.punto_de_simetria_superior,
    punto_0=cluster_13.punto_0_externos,
    punto_tuerca=cluster_13.punto_tuerca)  # -> mecanizados_2, tarugo, caja_minifix, minifix_de_presion, minifix_roscado, tornillo_largo, tornillo_pt, tuerca
cluster_18 = Cluster_4(
    sujecion_herrajes=rh_in_06_9_sujecion_superior_interno,
    simetria=rh_in_06_8_simetria,
    cambiar_lado=rh_in_06_12_cambiar_lado,
    mecanizados=cluster_14.mecanizados,
    punto_simetria=cluster_10.punto_de_simetria_superior,
    punto_0=cluster_14.punto_0_internos_2,
    punto_tuerca=cluster_14.punto_tuerca)  # -> mecanizados_2, tarugo, caja_minifix, minifix_de_presion, minifix_roscado, tornillo_largo, tornillo_pt, tuerca

# ---- group: Costado Derecho (continued)
solid_difference_4 = SolidDifference(
    BrepsA=stream_filter_3,
    Perforados=flatten([cluster_17.mecanizados_2, cluster_18.mecanizados_2, cluster_15.mecanizados_2, cluster_16.mecanizados_2]))

# ----
move_12 = Move(Geometry=box_2pt_3, Motion=stream_gate.Target3)  # -> Geometry, Transform
deconstruct_brep_8 = DeconstructBrep(Brep=move_12.Geometry)  # -> Faces, Edges, Vertices
list_item_14 = ListItem(List=deconstruct_brep_8.Vertices, Index="0", Wrap=True)
list_item_15 = ListItem(List=deconstruct_brep_8.Vertices, Index="2", Wrap=True)
list_item_16 = ListItem(List=deconstruct_brep_8.Edges, Index="0", Wrap=True)
curve_middle_3 = CurveMiddle(Curve=list_item_16)
move_13 = Move(Geometry=list_item_15, Motion=unit_z_4)  # -> Geometry, Transform
list_item_17 = ListItem(List=deconstruct_brep_8.Faces, Index="4", Wrap=True)
area_3 = Area(Geometry=list_item_17)  # -> Area, Centroid
box_2pt_7 = Box2Pt(PointA=list_item_14, PointB=move_13.Geometry, Plane=PlaneXY(0, 0, 0))
stream_filter_4 = StreamFilter(Gate=expression, Stream0=move_12.Geometry, Stream1=box_2pt_7)

cluster_19 = Cluster_6(
    posicion_externos_superior=rh_in_08_7_posicion,
    posicion_internos_superior=rh_in_08_10_posicion,
    relay=stream_filter_4,
    posicion_externos_inferior=rh_in_08_14_posicion,
    posicion_internos_inferior=rh_in_08_17_posicion)  # -> punto_de_simetria_superior, punto_0_externos_superior, punto_0_internos_superior, punto_de_simetria_inferior, punto_0_externos_inferior, punto_0_internos_inferior
cluster_20 = Cluster_2(
    sujecion_inferior_herraje=rh_in_08_13_sujecion_inferior_herraje_ex,
    cambiar_lado=rh_in_08_19_cambiar_lado,
    punto_0_internos=cluster_19.punto_0_externos_inferior)  # -> punto_0_internos_2, punto_tuerca, mecanizados
cluster_21 = Cluster_2(
    sujecion_inferior_herraje=rh_in_08_16_sujecion_inferior_herraje_in,
    cambiar_lado=rh_in_08_19_cambiar_lado,
    punto_0_internos=cluster_19.punto_0_internos_inferior)  # -> punto_0_internos_2, punto_tuerca, mecanizados
cluster_22 = Cluster_3(
    sujecion_inferior_herraje=rh_in_08_6_sujecion_superior_externo,
    cambiar_lado=rh_in_08_12_cambiar_lado,
    punto_0_internos=cluster_19.punto_0_externos_superior)  # -> punto_0_externos, punto_tuerca, mecanizados
cluster_23 = Cluster_5(
    sujecion_inferior_herraje=rh_in_08_9_sujecion_superior_interno,
    cambiar_lado=rh_in_08_12_cambiar_lado,
    punto_0_internos=cluster_19.punto_0_internos_superior)  # -> punto_0_internos_2, punto_tuerca, mecanizados
cluster_24 = Cluster(
    sujecion_herrajes=rh_in_08_13_sujecion_inferior_herraje_ex,
    simetria=rh_in_08_15_simetria,
    cambiar_lado=rh_in_08_19_cambiar_lado,
    mecanizados=cluster_20.mecanizados,
    punto_simetria=cluster_19.punto_de_simetria_inferior,
    punto_0=cluster_20.punto_0_internos_2,
    punto_tuerca=cluster_20.punto_tuerca)  # -> mecanizados_2, tarugo, caja_minifix, minifix_de_presion, minifix_roscado, tornillo_largo, tornillo_pt, tuerca
cluster_25 = Cluster(
    sujecion_herrajes=rh_in_08_16_sujecion_inferior_herraje_in,
    simetria=rh_in_08_18_simetria,
    cambiar_lado=rh_in_08_19_cambiar_lado,
    mecanizados=cluster_21.mecanizados,
    punto_simetria=cluster_19.punto_de_simetria_inferior,
    punto_0=cluster_21.punto_0_internos_2,
    punto_tuerca=cluster_21.punto_tuerca)  # -> mecanizados_2, tarugo, caja_minifix, minifix_de_presion, minifix_roscado, tornillo_largo, tornillo_pt, tuerca
cluster_26 = Cluster_4(
    sujecion_herrajes=rh_in_08_6_sujecion_superior_externo,
    simetria=rh_in_08_8_simetria,
    cambiar_lado=rh_in_08_12_cambiar_lado,
    mecanizados=cluster_22.mecanizados,
    punto_simetria=cluster_19.punto_de_simetria_superior,
    punto_0=cluster_22.punto_0_externos,
    punto_tuerca=cluster_22.punto_tuerca)  # -> mecanizados_2, tarugo, caja_minifix, minifix_de_presion, minifix_roscado, tornillo_largo, tornillo_pt, tuerca
cluster_27 = Cluster_4(
    sujecion_herrajes=rh_in_08_9_sujecion_superior_interno,
    simetria=rh_in_08_8_simetria,
    cambiar_lado=rh_in_08_12_cambiar_lado,
    mecanizados=cluster_23.mecanizados,
    punto_simetria=cluster_19.punto_de_simetria_superior,
    punto_0=cluster_23.punto_0_internos_2,
    punto_tuerca=cluster_23.punto_tuerca)  # -> mecanizados_2, tarugo, caja_minifix, minifix_de_presion, minifix_roscado, tornillo_largo, tornillo_pt, tuerca

solid_difference_5 = SolidDifference(
    BrepsA=stream_filter_4,
    Perforados=flatten([cluster_26.mecanizados_2, cluster_27.mecanizados_2, cluster_24.mecanizados_2, cluster_25.mecanizados_2]))

line = Line(StartPoint=curve_middle_3, EndPoint=move_5.Geometry)
deconstruct_vector = DeconstructVector(Vector=line)  # -> XComponent, YComponent, ZComponent
unit_x_5 = UnitX(Factor=deconstruct_vector.XComponent)
negative = Negative(Value=unit_x_5)
move_14 = Move(Geometry=move_7.Geometry, Motion=negative)  # -> Geometry, Transform
move_15 = Move(Geometry=move_6.Geometry, Motion=negative)  # -> Geometry, Transform
move_16 = Move(Geometry=mirror_3.Geometry, Motion=negative)  # -> Geometry, Transform
move_17 = Move(Geometry=mirror_2.Geometry, Motion=negative)  # -> Geometry, Transform
mirror_7 = Mirror(Geometry=[move_16.Geometry, move_15.Geometry], Plane=yz_plane_2)  # -> Geometry, Transform
mirror_8 = Mirror(Geometry=[move_17.Geometry, move_14.Geometry], Plane=yz_plane_2)  # -> Geometry, Transform

move_18 = Move(Geometry=box_2pt_3, Motion=stream_gate.Target2)  # -> Geometry, Transform
deconstruct_brep_9 = DeconstructBrep(Brep=move_18.Geometry)  # -> Faces, Edges, Vertices
list_item_18 = ListItem(List=deconstruct_brep_9.Vertices, Index="0", Wrap=True)
list_item_19 = ListItem(List=deconstruct_brep_9.Vertices, Index="2", Wrap=True)
list_item_20 = ListItem(List=deconstruct_brep_9.Edges, Index="0", Wrap=True)
list_item_21 = ListItem(List=deconstruct_brep_9.Faces, Index="4", Wrap=True)
move_19 = Move(Geometry=list_item_19, Motion=unit_z_6)  # -> Geometry, Transform
curve_middle_4 = CurveMiddle(Curve=list_item_20)
area_4 = Area(Geometry=list_item_21)  # -> Area, Centroid
box_2pt_8 = Box2Pt(PointA=list_item_18, PointB=move_19.Geometry, Plane=PlaneXY(0, 0, 0))
stream_filter_5 = StreamFilter(Gate=expression_3, Stream0=move_18.Geometry, Stream1=box_2pt_8)

cluster_28 = Cluster_6(
    posicion_externos_superior=rh_in_07_7_posicion,
    posicion_internos_superior=rh_in_07_10_posicion,
    relay=stream_filter_5,
    posicion_externos_inferior=rh_in_07_14_posicion,
    posicion_internos_inferior=rh_in_07_17_posicion)  # -> punto_de_simetria_superior, punto_0_externos_superior, punto_0_internos_superior, punto_de_simetria_inferior, punto_0_externos_inferior, punto_0_internos_inferior
cluster_29 = Cluster_2(
    sujecion_inferior_herraje=rh_in_07_13_sujecion_inferior_herraje_ex,
    cambiar_lado=rh_in_07_19_cambiar_lado,
    punto_0_internos=cluster_28.punto_0_externos_inferior)  # -> punto_0_internos_2, punto_tuerca, mecanizados
cluster_30 = Cluster_2(
    sujecion_inferior_herraje=rh_in_07_16_sujecion_inferior_herraje_in,
    cambiar_lado=rh_in_07_19_cambiar_lado,
    punto_0_internos=cluster_28.punto_0_internos_inferior)  # -> punto_0_internos_2, punto_tuerca, mecanizados
cluster_31 = Cluster_3(
    sujecion_inferior_herraje=rh_in_07_6_sujecion_superior_externo,
    cambiar_lado=rh_in_07_12_cambiar_lado,
    punto_0_internos=cluster_28.punto_0_externos_superior)  # -> punto_0_externos, punto_tuerca, mecanizados
cluster_32 = Cluster_5(
    sujecion_inferior_herraje=rh_in_07_9_sujecion_superior_interno,
    cambiar_lado=rh_in_07_12_cambiar_lado,
    punto_0_internos=cluster_28.punto_0_internos_superior)  # -> punto_0_internos_2, punto_tuerca, mecanizados
cluster_33 = Cluster(
    sujecion_herrajes=rh_in_07_13_sujecion_inferior_herraje_ex,
    simetria=rh_in_07_15_simetria,
    cambiar_lado=rh_in_07_19_cambiar_lado,
    mecanizados=cluster_29.mecanizados,
    punto_simetria=cluster_28.punto_de_simetria_inferior,
    punto_0=cluster_29.punto_0_internos_2,
    punto_tuerca=cluster_29.punto_tuerca)  # -> mecanizados_2, tarugo, caja_minifix, minifix_de_presion, minifix_roscado, tornillo_largo, tornillo_pt, tuerca
cluster_34 = Cluster(
    sujecion_herrajes=rh_in_07_16_sujecion_inferior_herraje_in,
    simetria=rh_in_07_18_simetria,
    cambiar_lado=rh_in_07_19_cambiar_lado,
    mecanizados=cluster_30.mecanizados,
    punto_simetria=cluster_28.punto_de_simetria_inferior,
    punto_0=cluster_30.punto_0_internos_2,
    punto_tuerca=cluster_30.punto_tuerca)  # -> mecanizados_2, tarugo, caja_minifix, minifix_de_presion, minifix_roscado, tornillo_largo, tornillo_pt, tuerca
cluster_35 = Cluster_4(
    sujecion_herrajes=rh_in_07_6_sujecion_superior_externo,
    simetria=rh_in_07_8_simetria,
    cambiar_lado=rh_in_07_12_cambiar_lado,
    mecanizados=cluster_31.mecanizados,
    punto_simetria=cluster_28.punto_de_simetria_superior,
    punto_0=cluster_31.punto_0_externos,
    punto_tuerca=cluster_31.punto_tuerca)  # -> mecanizados_2, tarugo, caja_minifix, minifix_de_presion, minifix_roscado, tornillo_largo, tornillo_pt, tuerca
cluster_36 = Cluster_4(
    sujecion_herrajes=rh_in_07_9_sujecion_superior_interno,
    simetria=rh_in_07_8_simetria,
    cambiar_lado=rh_in_07_12_cambiar_lado,
    mecanizados=cluster_32.mecanizados,
    punto_simetria=cluster_28.punto_de_simetria_superior,
    punto_0=cluster_32.punto_0_internos_2,
    punto_tuerca=cluster_32.punto_tuerca)  # -> mecanizados_2, tarugo, caja_minifix, minifix_de_presion, minifix_roscado, tornillo_largo, tornillo_pt, tuerca
solid_difference_6 = SolidDifference(
    BrepsA=stream_filter_5,
    Perforados=flatten([cluster_35.mecanizados_2, cluster_36.mecanizados_2, cluster_33.mecanizados_2, cluster_34.mecanizados_2]))

line_2 = Line(StartPoint=move_5.Geometry, EndPoint=curve_middle_4)
deconstruct_vector_2 = DeconstructVector(Vector=line_2)  # -> XComponent, YComponent, ZComponent
unit_x_6 = UnitX(Factor=deconstruct_vector_2.XComponent)
move_20 = Move(Geometry=move_6.Geometry, Motion=unit_x_6)  # -> Geometry, Transform
move_21 = Move(Geometry=move_7.Geometry, Motion=unit_x_6)  # -> Geometry, Transform
move_22 = Move(Geometry=mirror_3.Geometry, Motion=unit_x_6)  # -> Geometry, Transform
move_23 = Move(Geometry=mirror_2.Geometry, Motion=unit_x_6)  # -> Geometry, Transform

# ---- group: Division Media Izquierda (continued)
move_24 = Move(Geometry=box_2pt_3, Motion=stream_gate.Target4)  # -> Geometry, Transform
deconstruct_brep_10 = DeconstructBrep(Brep=move_24.Geometry)  # -> Faces, Edges, Vertices
list_item_22 = ListItem(List=deconstruct_brep_10.Vertices, Index="1", Wrap=True)
list_item_23 = ListItem(List=deconstruct_brep_10.Vertices, Index="5", Wrap=True)
list_item_24 = ListItem(List=deconstruct_brep_10.Vertices, Index="3", Wrap=True)
list_item_25 = ListItem(List=deconstruct_brep_10.Faces, Index="4", Wrap=True)
list_item_26 = ListItem(List=deconstruct_brep_10.Edges, Index="0", Wrap=True)
curve_middle_5 = CurveMiddle(Curve=list_item_26)
move_25 = Move(Geometry=list_item_22, Motion=unit_z_8)  # -> Geometry, Transform
box_2pt_9 = Box2Pt(PointA=list_item_23, PointB=list_item_24, Plane=PlaneXY(0, 0, 0))
area_5 = Area(Geometry=list_item_25)  # -> Area, Centroid
move_26 = Move(Geometry=curve_middle_5, Motion=unit_y_2)  # -> Geometry, Transform
box_2pt_10 = Box2Pt(PointA=list_item_24, PointB=move_25.Geometry, Plane=PlaneXY(0, 0, 0))
stream_filter_6 = StreamFilter(Gate=expression_5, Stream0=box_2pt_9, Stream1=box_2pt_10)

# ----
cluster_37 = Cluster_6(
    posicion_externos_superior=rh_in_10_7_posicion,
    posicion_internos_superior=rh_in_10_10_posicion,
    relay=stream_filter_6,
    posicion_externos_inferior=rh_in_10_14_posicion,
    posicion_internos_inferior=rh_in_10_17_posicion)  # -> punto_de_simetria_superior, punto_0_externos_superior, punto_0_internos_superior, punto_de_simetria_inferior, punto_0_externos_inferior, punto_0_internos_inferior
cluster_38 = Cluster_2(
    sujecion_inferior_herraje=rh_in_10_13_sujecion_inferior_herraje_ex,
    cambiar_lado=rh_in_10_19_cambiar_lado,
    punto_0_internos=cluster_37.punto_0_externos_inferior)  # -> punto_0_internos_2, punto_tuerca, mecanizados
cluster_39 = Cluster_2(
    sujecion_inferior_herraje=rh_in_10_16_sujecion_inferior_herraje_in,
    cambiar_lado=rh_in_10_19_cambiar_lado,
    punto_0_internos=cluster_37.punto_0_internos_inferior)  # -> punto_0_internos_2, punto_tuerca, mecanizados
cluster_40 = Cluster_3(
    sujecion_inferior_herraje=rh_in_10_6_sujecion_superior_externo,
    cambiar_lado=rh_in_10_12_cambiar_lado,
    punto_0_internos=cluster_37.punto_0_externos_superior)  # -> punto_0_externos, punto_tuerca, mecanizados
cluster_41 = Cluster_5(
    sujecion_inferior_herraje=rh_in_10_9_sujecion_superior_interno,
    cambiar_lado=rh_in_10_12_cambiar_lado,
    punto_0_internos=cluster_37.punto_0_internos_superior)  # -> punto_0_internos_2, punto_tuerca, mecanizados
cluster_42 = Cluster(
    sujecion_herrajes=rh_in_10_13_sujecion_inferior_herraje_ex,
    simetria=rh_in_10_15_simetria,
    cambiar_lado=rh_in_10_19_cambiar_lado,
    mecanizados=cluster_38.mecanizados,
    punto_simetria=cluster_37.punto_de_simetria_inferior,
    punto_0=cluster_38.punto_0_internos_2,
    punto_tuerca=cluster_38.punto_tuerca)  # -> mecanizados_2, tarugo, caja_minifix, minifix_de_presion, minifix_roscado, tornillo_largo, tornillo_pt, tuerca
cluster_43 = Cluster(
    sujecion_herrajes=rh_in_10_16_sujecion_inferior_herraje_in,
    simetria=rh_in_10_18_simetria,
    cambiar_lado=rh_in_10_19_cambiar_lado,
    mecanizados=cluster_39.mecanizados,
    punto_simetria=cluster_37.punto_de_simetria_inferior,
    punto_0=cluster_39.punto_0_internos_2,
    punto_tuerca=cluster_39.punto_tuerca)  # -> mecanizados_2, tarugo, caja_minifix, minifix_de_presion, minifix_roscado, tornillo_largo, tornillo_pt, tuerca
cluster_44 = Cluster_4(
    sujecion_herrajes=rh_in_10_6_sujecion_superior_externo,
    simetria=rh_in_10_8_simetria,
    cambiar_lado=rh_in_10_12_cambiar_lado,
    mecanizados=cluster_40.mecanizados,
    punto_simetria=cluster_37.punto_de_simetria_superior,
    punto_0=cluster_40.punto_0_externos,
    punto_tuerca=cluster_40.punto_tuerca)  # -> mecanizados_2, tarugo, caja_minifix, minifix_de_presion, minifix_roscado, tornillo_largo, tornillo_pt, tuerca
cluster_45 = Cluster_4(
    sujecion_herrajes=rh_in_10_9_sujecion_superior_interno,
    simetria=rh_in_10_8_simetria,
    cambiar_lado=rh_in_10_12_cambiar_lado,
    mecanizados=cluster_41.mecanizados,
    punto_simetria=cluster_37.punto_de_simetria_superior,
    punto_0=cluster_41.punto_0_internos_2,
    punto_tuerca=cluster_41.punto_tuerca)  # -> mecanizados_2, tarugo, caja_minifix, minifix_de_presion, minifix_roscado, tornillo_largo, tornillo_pt, tuerca

# ---- group: Division Media Izquierda (continued)
solid_difference_7 = SolidDifference(
    BrepsA=stream_filter_6,
    Perforados=flatten([cluster_43.mecanizados_2, cluster_42.mecanizados_2, cluster_45.mecanizados_2, cluster_44.mecanizados_2]))

# ----
move_27 = Move(Geometry=area_5.Centroid, Motion=unit_z_2)  # -> Geometry, Transform
stream_filter_7 = StreamFilter(Centroide=rh_in_02_0_divisiones, Stream4=move_27.Geometry)
stream_filter_8 = StreamFilter(Centroide=rh_in_02_0_divisiones, Stream4=move_27.Geometry)
vector_2pt_3 = Vector2Pt(PointA=move_5.Geometry, PointB=stream_filter_8, Unitize=False)  # -> Vector, Length
move_28 = Move(Geometry=move_7.Geometry, Motion=vector_2pt_3.Vector)  # -> Geometry, Transform
mirror_9 = Mirror(Geometry=move_28.Geometry, Plane=yz_plane_2)  # -> Geometry, Transform

vector_2pt_4 = Vector2Pt(PointA=move_5.Geometry, PointB=stream_filter_7, Unitize=False)  # -> Vector, Length
move_29 = Move(Geometry=move_6.Geometry, Motion=vector_2pt_4.Vector)  # -> Geometry, Transform

mirror_10 = Mirror(Geometry=move_29.Geometry, Plane=yz_plane_2)  # -> Geometry, Transform

# ---- group: Division Media Derecha (continued)
mirror_11 = Mirror(Geometry=move_24.Geometry, Plane=yz_plane)  # -> Geometry, Transform
deconstruct_brep_11 = DeconstructBrep(Brep=mirror_11.Geometry)  # -> Faces, Edges, Vertices
list_item_27 = ListItem(List=deconstruct_brep_11.Vertices, Index="4", Wrap=True)
list_item_28 = ListItem(List=deconstruct_brep_11.Vertices, Index="0", Wrap=True)
list_item_29 = ListItem(List=deconstruct_brep_11.Vertices, Index="6", Wrap=True)
move_30 = Move(Geometry=list_item_27, Motion=unit_z_9)  # -> Geometry, Transform
box_2pt_11 = Box2Pt(PointA=list_item_28, PointB=list_item_29, Plane=PlaneXY(0, 0, 0))
box_2pt_12 = Box2Pt(PointA=list_item_29, PointB=move_30.Geometry, Plane=PlaneXY(0, 0, 0))
stream_filter_9 = StreamFilter(Gate=expression_6, Stream0=box_2pt_11, Stream1=box_2pt_12)

# ----
cluster_46 = Cluster_6(
    posicion_externos_superior=rh_in_12_7_posicion,
    posicion_internos_superior=rh_in_12_10_posicion,
    relay=stream_filter_9,
    posicion_externos_inferior=rh_in_12_14_posicion,
    posicion_internos_inferior=rh_in_12_17_posicion)  # -> punto_de_simetria_superior, punto_0_externos_superior, punto_0_internos_superior, punto_de_simetria_inferior, punto_0_externos_inferior, punto_0_internos_inferior
cluster_47 = Cluster_2(
    sujecion_inferior_herraje=rh_in_12_13_sujecion_inferior_herraje_ex,
    cambiar_lado=rh_in_12_19_cambiar_lado,
    punto_0_internos=cluster_46.punto_0_externos_inferior)  # -> punto_0_internos_2, punto_tuerca, mecanizados
cluster_48 = Cluster_2(
    sujecion_inferior_herraje=rh_in_12_16_sujecion_inferior_herraje_in,
    cambiar_lado=rh_in_12_19_cambiar_lado,
    punto_0_internos=cluster_46.punto_0_internos_inferior)  # -> punto_0_internos_2, punto_tuerca, mecanizados
cluster_49 = Cluster_3(
    sujecion_inferior_herraje=rh_in_12_6_sujecion_superior_externo,
    cambiar_lado=rh_in_12_12_cambiar_lado,
    punto_0_internos=cluster_46.punto_0_externos_superior)  # -> punto_0_externos, punto_tuerca, mecanizados
cluster_50 = Cluster_5(
    sujecion_inferior_herraje=rh_in_12_9_sujecion_superior_interno,
    cambiar_lado=rh_in_12_12_cambiar_lado,
    punto_0_internos=cluster_46.punto_0_internos_superior)  # -> punto_0_internos_2, punto_tuerca, mecanizados
cluster_51 = Cluster(
    sujecion_herrajes=rh_in_12_13_sujecion_inferior_herraje_ex,
    simetria=rh_in_12_15_simetria,
    cambiar_lado=rh_in_12_19_cambiar_lado,
    mecanizados=cluster_47.mecanizados,
    punto_simetria=cluster_46.punto_de_simetria_inferior,
    punto_0=cluster_47.punto_0_internos_2,
    punto_tuerca=cluster_47.punto_tuerca)  # -> mecanizados_2, tarugo, caja_minifix, minifix_de_presion, minifix_roscado, tornillo_largo, tornillo_pt, tuerca
cluster_52 = Cluster(
    sujecion_herrajes=rh_in_12_16_sujecion_inferior_herraje_in,
    simetria=rh_in_12_18_simetria,
    cambiar_lado=rh_in_12_19_cambiar_lado,
    mecanizados=cluster_48.mecanizados,
    punto_simetria=cluster_46.punto_de_simetria_inferior,
    punto_0=cluster_48.punto_0_internos_2,
    punto_tuerca=cluster_48.punto_tuerca)  # -> mecanizados_2, tarugo, caja_minifix, minifix_de_presion, minifix_roscado, tornillo_largo, tornillo_pt, tuerca
cluster_53 = Cluster_4(
    sujecion_herrajes=rh_in_12_6_sujecion_superior_externo,
    simetria=rh_in_12_8_simetria,
    cambiar_lado=rh_in_12_12_cambiar_lado,
    mecanizados=cluster_49.mecanizados,
    punto_simetria=cluster_46.punto_de_simetria_superior,
    punto_0=cluster_49.punto_0_externos,
    punto_tuerca=cluster_49.punto_tuerca)  # -> mecanizados_2, tarugo, caja_minifix, minifix_de_presion, minifix_roscado, tornillo_largo, tornillo_pt, tuerca
cluster_54 = Cluster_4(
    sujecion_herrajes=rh_in_12_9_sujecion_superior_interno,
    simetria=rh_in_12_8_simetria,
    cambiar_lado=rh_in_12_12_cambiar_lado,
    mecanizados=cluster_50.mecanizados,
    punto_simetria=cluster_46.punto_de_simetria_superior,
    punto_0=cluster_50.punto_0_internos_2,
    punto_tuerca=cluster_50.punto_tuerca)  # -> mecanizados_2, tarugo, caja_minifix, minifix_de_presion, minifix_roscado, tornillo_largo, tornillo_pt, tuerca

# ---- group: Division Media Derecha (continued)
solid_difference_8 = SolidDifference(
    BrepsA=stream_filter_9,
    Perforados=flatten([cluster_53.mecanizados_2, cluster_54.mecanizados_2, cluster_51.mecanizados_2, cluster_52.mecanizados_2]))

# ----
mirror_12 = Mirror(Geometry=move_12.Geometry, Plane=yz_plane)  # -> Geometry, Transform
deconstruct_brep_12 = DeconstructBrep(Brep=mirror_12.Geometry)  # -> Faces, Edges, Vertices
list_item_30 = ListItem(List=deconstruct_brep_12.Vertices, Index="5", Wrap=True)
list_item_31 = ListItem(List=deconstruct_brep_12.Vertices, Index="7", Wrap=True)
list_item_32 = ListItem(List=deconstruct_brep_12.Vertices, Index="3", Wrap=True)
move_31 = Move(Geometry=list_item_31, Motion=unit_z_10)  # -> Geometry, Transform
box_2pt_13 = Box2Pt(PointA=list_item_30, PointB=list_item_32, Plane=PlaneXY(0, 0, 0))
box_2pt_14 = Box2Pt(PointA=list_item_30, PointB=move_31.Geometry, Plane=PlaneXY(0, 0, 0))
stream_filter_10 = StreamFilter(Gate=expression_7, Stream0=box_2pt_13, Stream1=box_2pt_14)

cluster_55 = Cluster_6(
    posicion_externos_superior=rh_in_09_7_posicion,
    posicion_internos_superior=rh_in_09_10_posicion,
    relay=stream_filter_10,
    posicion_externos_inferior=rh_in_09_14_posicion,
    posicion_internos_inferior=rh_in_09_17_posicion)  # -> punto_de_simetria_superior, punto_0_externos_superior, punto_0_internos_superior, punto_de_simetria_inferior, punto_0_externos_inferior, punto_0_internos_inferior
cluster_56 = Cluster_2(
    sujecion_inferior_herraje=rh_in_09_13_sujecion_inferior_herraje_ex,
    cambiar_lado=rh_in_09_19_cambiar_lado,
    punto_0_internos=cluster_55.punto_0_externos_inferior)  # -> punto_0_internos_2, punto_tuerca, mecanizados
cluster_57 = Cluster_2(
    sujecion_inferior_herraje=rh_in_09_16_sujecion_inferior_herraje_in,
    cambiar_lado=rh_in_09_19_cambiar_lado,
    punto_0_internos=cluster_55.punto_0_internos_inferior)  # -> punto_0_internos_2, punto_tuerca, mecanizados
cluster_58 = Cluster_3(
    sujecion_inferior_herraje=rh_in_09_6_sujecion_superior_externo,
    cambiar_lado=rh_in_09_12_cambiar_lado,
    punto_0_internos=cluster_55.punto_0_externos_superior)  # -> punto_0_externos, punto_tuerca, mecanizados
cluster_59 = Cluster_5(
    sujecion_inferior_herraje=rh_in_09_9_sujecion_superior_interno,
    cambiar_lado=rh_in_09_12_cambiar_lado,
    punto_0_internos=cluster_55.punto_0_internos_superior)  # -> punto_0_internos_2, punto_tuerca, mecanizados
cluster_60 = Cluster(
    sujecion_herrajes=rh_in_09_13_sujecion_inferior_herraje_ex,
    simetria=rh_in_09_15_simetria,
    cambiar_lado=rh_in_09_19_cambiar_lado,
    mecanizados=cluster_56.mecanizados,
    punto_simetria=cluster_55.punto_de_simetria_inferior,
    punto_0=cluster_56.punto_0_internos_2,
    punto_tuerca=cluster_56.punto_tuerca)  # -> mecanizados_2, tarugo, caja_minifix, minifix_de_presion, minifix_roscado, tornillo_largo, tornillo_pt, tuerca
cluster_61 = Cluster(
    sujecion_herrajes=rh_in_09_16_sujecion_inferior_herraje_in,
    simetria=rh_in_09_18_simetria,
    cambiar_lado=rh_in_09_19_cambiar_lado,
    mecanizados=cluster_57.mecanizados,
    punto_simetria=cluster_55.punto_de_simetria_inferior,
    punto_0=cluster_57.punto_0_internos_2,
    punto_tuerca=cluster_57.punto_tuerca)  # -> mecanizados_2, tarugo, caja_minifix, minifix_de_presion, minifix_roscado, tornillo_largo, tornillo_pt, tuerca
cluster_62 = Cluster_4(
    sujecion_herrajes=rh_in_09_6_sujecion_superior_externo,
    simetria=rh_in_09_8_simetria,
    cambiar_lado=rh_in_09_12_cambiar_lado,
    mecanizados=cluster_58.mecanizados,
    punto_simetria=cluster_55.punto_de_simetria_superior,
    punto_0=cluster_58.punto_0_externos,
    punto_tuerca=cluster_58.punto_tuerca)  # -> mecanizados_2, tarugo, caja_minifix, minifix_de_presion, minifix_roscado, tornillo_largo, tornillo_pt, tuerca
cluster_63 = Cluster_4(
    sujecion_herrajes=rh_in_09_9_sujecion_superior_interno,
    simetria=rh_in_09_8_simetria,
    cambiar_lado=rh_in_09_12_cambiar_lado,
    mecanizados=cluster_59.mecanizados,
    punto_simetria=cluster_55.punto_de_simetria_superior,
    punto_0=cluster_59.punto_0_internos_2,
    punto_tuerca=cluster_59.punto_tuerca)  # -> mecanizados_2, tarugo, caja_minifix, minifix_de_presion, minifix_roscado, tornillo_largo, tornillo_pt, tuerca

solid_difference_9 = SolidDifference(
    BrepsA=stream_filter_10,
    Perforados=flatten([cluster_62.mecanizados_2, cluster_63.mecanizados_2, cluster_60.mecanizados_2, cluster_61.mecanizados_2]))

# ---- group: Division Media (continued)
unit_x_7 = UnitX(Factor=division)
move_32 = Move(Geometry=move_24.Geometry, Motion=unit_x_7)  # -> Geometry, Transform
deconstruct_brep_13 = DeconstructBrep(Brep=move_32.Geometry)  # -> Faces, Edges, Vertices
list_item_33 = ListItem(List=deconstruct_brep_13.Vertices, Index="1", Wrap=True)
list_item_34 = ListItem(List=deconstruct_brep_13.Vertices, Index="5", Wrap=True)
list_item_35 = ListItem(List=deconstruct_brep_13.Edges, Index="0", Wrap=True)
list_item_36 = ListItem(List=deconstruct_brep_13.Vertices, Index="3", Wrap=True)
curve_middle_6 = CurveMiddle(Curve=list_item_35)
box_2pt_15 = Box2Pt(PointA=list_item_34, PointB=list_item_36, Plane=PlaneXY(0, 0, 0))
move_33 = Move(Geometry=list_item_33, Motion=unit_z_11)  # -> Geometry, Transform
box_2pt_16 = Box2Pt(PointA=list_item_36, PointB=move_33.Geometry, Plane=PlaneXY(0, 0, 0))
stream_filter_11 = StreamFilter(Gate=expression_8, Stream0=move_32.Geometry, Stream1=box_2pt_16)

# ----
line_3 = Line(StartPoint=move_5.Geometry, EndPoint=curve_middle_6)
deconstruct_vector_3 = DeconstructVector(Vector=line_3)  # -> XComponent, YComponent, ZComponent
unit_x_8 = UnitX(Factor=deconstruct_vector_3.XComponent)
move_34 = Move(Geometry=move_6.Geometry, Motion=unit_x_8)  # -> Geometry, Transform
move_35 = Move(Geometry=move_7.Geometry, Motion=unit_x_8)  # -> Geometry, Transform
mirror_13 = Mirror(Geometry=move_34.Geometry, Plane=xz_plane)  # -> Geometry, Transform
mirror_14 = Mirror(Geometry=move_35.Geometry, Plane=xz_plane)  # -> Geometry, Transform
stream_filter_12 = StreamFilter(
    Gate=expression_10,
    Stream0=[mirror_5.Geometry, mirror_2.Geometry, mirror_14.Geometry, mirror_9.Geometry, move_14.Geometry, move_17.Geometry, mirror_8.Geometry, move_23.Geometry, move_7.Geometry, move_35.Geometry, move_21.Geometry, move_28.Geometry, mirror.Geometry])
stream_filter_13 = StreamFilter(
    Gate=expression_10,
    Stream1=[mirror_3.Geometry, mirror_4.Geometry, mirror_13.Geometry, mirror_10.Geometry, move_16.Geometry, mirror_7.Geometry, move_20.Geometry, move_22.Geometry, move_6.Geometry, move_34.Geometry, move_15.Geometry, move_29.Geometry])
pata_cilindrica = Geometry(stream_filter_13)
pata_conica = Geometry(stream_filter_12)

cluster_64 = Cluster_6(
    posicion_externos_superior=rh_in_11_7_posicion,
    posicion_internos_superior=rh_in_11_10_posicion,
    relay=stream_filter_11,
    posicion_externos_inferior=rh_in_11_14_posicion,
    posicion_internos_inferior=rh_in_11_17_posicion)  # -> punto_de_simetria_superior, punto_0_externos_superior, punto_0_internos_superior, punto_de_simetria_inferior, punto_0_externos_inferior, punto_0_internos_inferior
cluster_65 = Cluster_2(
    sujecion_inferior_herraje=rh_in_11_13_sujecion_inferior_herraje_ex,
    cambiar_lado=rh_in_11_19_cambiar_lado,
    punto_0_internos=cluster_64.punto_0_externos_inferior)  # -> punto_0_internos_2, punto_tuerca, mecanizados
cluster_66 = Cluster_2(
    sujecion_inferior_herraje=rh_in_11_16_sujecion_inferior_herraje_in,
    cambiar_lado=rh_in_11_19_cambiar_lado,
    punto_0_internos=cluster_64.punto_0_internos_inferior)  # -> punto_0_internos_2, punto_tuerca, mecanizados
cluster_67 = Cluster_3(
    sujecion_inferior_herraje=rh_in_11_6_sujecion_superior_externo,
    cambiar_lado=rh_in_11_12_cambiar_lado,
    punto_0_internos=cluster_64.punto_0_externos_superior)  # -> punto_0_externos, punto_tuerca, mecanizados
cluster_68 = Cluster_5(
    sujecion_inferior_herraje=rh_in_11_9_sujecion_superior_interno,
    cambiar_lado=rh_in_11_12_cambiar_lado,
    punto_0_internos=cluster_64.punto_0_internos_superior)  # -> punto_0_internos_2, punto_tuerca, mecanizados
cluster_69 = Cluster(
    sujecion_herrajes=rh_in_11_13_sujecion_inferior_herraje_ex,
    simetria=rh_in_11_15_simetria,
    cambiar_lado=rh_in_11_19_cambiar_lado,
    mecanizados=cluster_65.mecanizados,
    punto_simetria=cluster_64.punto_de_simetria_inferior,
    punto_0=cluster_65.punto_0_internos_2,
    punto_tuerca=cluster_65.punto_tuerca)  # -> mecanizados_2, tarugo, caja_minifix, minifix_de_presion, minifix_roscado, tornillo_largo, tornillo_pt, tuerca
cluster_70 = Cluster(
    sujecion_herrajes=rh_in_11_16_sujecion_inferior_herraje_in,
    simetria=rh_in_11_18_simetria,
    cambiar_lado=rh_in_11_19_cambiar_lado,
    mecanizados=cluster_66.mecanizados,
    punto_simetria=cluster_64.punto_de_simetria_inferior,
    punto_0=cluster_66.punto_0_internos_2,
    punto_tuerca=cluster_66.punto_tuerca)  # -> mecanizados_2, tarugo, caja_minifix, minifix_de_presion, minifix_roscado, tornillo_largo, tornillo_pt, tuerca
cluster_71 = Cluster_4(
    sujecion_herrajes=rh_in_11_6_sujecion_superior_externo,
    simetria=rh_in_11_8_simetria,
    cambiar_lado=rh_in_11_12_cambiar_lado,
    mecanizados=cluster_67.mecanizados,
    punto_simetria=cluster_64.punto_de_simetria_superior,
    punto_0=cluster_67.punto_0_externos,
    punto_tuerca=cluster_67.punto_tuerca)  # -> mecanizados_2, tarugo, caja_minifix, minifix_de_presion, minifix_roscado, tornillo_largo, tornillo_pt, tuerca
cluster_72 = Cluster_4(
    sujecion_herrajes=rh_in_11_9_sujecion_superior_interno,
    simetria=rh_in_11_8_simetria,
    cambiar_lado=rh_in_11_12_cambiar_lado,
    mecanizados=cluster_68.mecanizados,
    punto_simetria=cluster_64.punto_de_simetria_superior,
    punto_0=cluster_68.punto_0_internos_2,
    punto_tuerca=cluster_68.punto_tuerca)  # -> mecanizados_2, tarugo, caja_minifix, minifix_de_presion, minifix_roscado, tornillo_largo, tornillo_pt, tuerca

# ---- group: Division Media (continued)
solid_difference_10 = SolidDifference(
    BrepsA=stream_filter_11,
    Perforados=flatten([cluster_71.mecanizados_2, cluster_72.mecanizados_2, cluster_69.mecanizados_2, cluster_70.mecanizados_2]))

# ----
rh_out_minifix_de_presion = Geometry([cluster_7.minifix_de_presion, cluster_6.minifix_de_presion, cluster_8.minifix_de_presion, cluster_9.minifix_de_presion, cluster_17.minifix_de_presion, cluster_18.minifix_de_presion, cluster_15.minifix_de_presion, cluster_16.minifix_de_presion, cluster_35.minifix_de_presion, cluster_36.minifix_de_presion, cluster_33.minifix_de_presion, cluster_34.minifix_de_presion, cluster_26.minifix_de_presion, cluster_27.minifix_de_presion, cluster_24.minifix_de_presion, cluster_25.minifix_de_presion, cluster_62.minifix_de_presion, cluster_63.minifix_de_presion, cluster_60.minifix_de_presion, cluster_61.minifix_de_presion, cluster_44.minifix_de_presion, cluster_45.minifix_de_presion, cluster_42.minifix_de_presion, cluster_43.minifix_de_presion, cluster_71.minifix_de_presion, cluster_72.minifix_de_presion, cluster_69.minifix_de_presion, cluster_70.minifix_de_presion, cluster_53.minifix_de_presion, cluster_54.minifix_de_presion, cluster_51.minifix_de_presion, cluster_52.minifix_de_presion])
rh_out_minifix_roscado = Geometry([cluster_7.minifix_roscado, cluster_6.minifix_roscado, cluster_8.minifix_roscado, cluster_9.minifix_roscado, cluster_17.minifix_roscado, cluster_18.minifix_roscado, cluster_15.minifix_roscado, cluster_16.minifix_roscado, cluster_35.minifix_roscado, cluster_36.minifix_roscado, cluster_33.minifix_roscado, cluster_34.minifix_roscado, cluster_26.minifix_roscado, cluster_27.minifix_roscado, cluster_24.minifix_roscado, cluster_25.minifix_roscado, cluster_62.minifix_roscado, cluster_63.minifix_roscado, cluster_60.minifix_roscado, cluster_61.minifix_roscado, cluster_44.minifix_roscado, cluster_45.minifix_roscado, cluster_42.minifix_roscado, cluster_43.minifix_roscado, cluster_71.minifix_roscado, cluster_72.minifix_roscado, cluster_69.minifix_roscado, cluster_70.minifix_roscado, cluster_53.minifix_roscado, cluster_54.minifix_roscado, cluster_51.minifix_roscado, cluster_52.minifix_roscado])
rh_out_caja_minifix = Geometry([cluster_7.caja_minifix, cluster_6.caja_minifix, cluster_8.caja_minifix, cluster_9.caja_minifix, cluster_17.caja_minifix, cluster_18.caja_minifix, cluster_15.caja_minifix, cluster_16.caja_minifix, cluster_35.caja_minifix, cluster_36.caja_minifix, cluster_33.caja_minifix, cluster_34.caja_minifix, cluster_26.caja_minifix, cluster_27.caja_minifix, cluster_24.caja_minifix, cluster_25.caja_minifix, cluster_62.caja_minifix, cluster_63.caja_minifix, cluster_60.caja_minifix, cluster_61.caja_minifix, cluster_44.caja_minifix, cluster_45.caja_minifix, cluster_42.caja_minifix, cluster_43.caja_minifix, cluster_71.caja_minifix, cluster_72.caja_minifix, cluster_69.caja_minifix, cluster_70.caja_minifix, cluster_53.caja_minifix, cluster_54.caja_minifix, cluster_51.caja_minifix, cluster_52.caja_minifix])
rh_out_tornillo_largo = Geometry([cluster_7.tornillo_largo, cluster_6.tornillo_largo, cluster_8.tornillo_largo, cluster_9.tornillo_largo, cluster_17.tornillo_largo, cluster_18.tornillo_largo, cluster_15.tornillo_largo, cluster_16.tornillo_largo, cluster_35.tornillo_largo, cluster_36.tornillo_largo, cluster_33.tornillo_largo, cluster_34.tornillo_largo, cluster_26.tornillo_largo, cluster_27.tornillo_largo, cluster_24.tornillo_largo, cluster_25.tornillo_largo, cluster_62.tornillo_largo, cluster_63.tornillo_largo, cluster_60.tornillo_largo, cluster_61.tornillo_largo, cluster_44.tornillo_largo, cluster_45.tornillo_largo, cluster_42.tornillo_largo, cluster_43.tornillo_largo, cluster_71.tornillo_largo, cluster_72.tornillo_largo, cluster_69.tornillo_largo, cluster_70.tornillo_largo, cluster_53.tornillo_largo, cluster_54.tornillo_largo, cluster_51.tornillo_largo, cluster_52.tornillo_largo])
rh_out_tarugo = Geometry([cluster_6.tarugo, cluster_7.tarugo, cluster_8.tarugo, cluster_9.tarugo, cluster_17.tarugo, cluster_18.tarugo, cluster_15.tarugo, cluster_16.tarugo, cluster_35.tarugo, cluster_36.tarugo, cluster_33.tarugo, cluster_34.tarugo, cluster_26.tarugo, cluster_27.tarugo, cluster_24.tarugo, cluster_25.tarugo, cluster_62.tarugo, cluster_63.tarugo, cluster_60.tarugo, cluster_61.tarugo, cluster_44.tarugo, cluster_45.tarugo, cluster_42.tarugo, cluster_43.tarugo, cluster_71.tarugo, cluster_72.tarugo, cluster_69.tarugo, cluster_70.tarugo, cluster_53.tarugo, cluster_54.tarugo, cluster_51.tarugo, cluster_52.tarugo])
rh_out_tornillo_pt = Geometry([cluster_7.tornillo_pt, cluster_6.tornillo_pt, cluster_8.tornillo_pt, cluster_9.tornillo_pt, cluster_17.tornillo_pt, cluster_18.tornillo_pt, cluster_15.tornillo_pt, cluster_16.tornillo_pt, cluster_35.tornillo_pt, cluster_36.tornillo_pt, cluster_33.tornillo_pt, cluster_34.tornillo_pt, cluster_26.tornillo_pt, cluster_27.tornillo_pt, cluster_24.tornillo_pt, cluster_25.tornillo_pt, cluster_62.tornillo_pt, cluster_63.tornillo_pt, cluster_60.tornillo_pt, cluster_61.tornillo_pt, cluster_44.tornillo_pt, cluster_45.tornillo_pt, cluster_42.tornillo_pt, cluster_43.tornillo_pt, cluster_71.tornillo_pt, cluster_72.tornillo_pt, cluster_69.tornillo_pt, cluster_70.tornillo_pt, cluster_53.tornillo_pt, cluster_54.tornillo_pt, cluster_51.tornillo_pt, cluster_52.tornillo_pt])
rh_out_tuerca = Geometry([cluster_7.tuerca, cluster_6.tuerca, cluster_8.tuerca, cluster_9.tuerca, cluster_17.tuerca, cluster_18.tuerca, cluster_15.tuerca, cluster_16.tuerca, cluster_35.tuerca, cluster_36.tuerca, cluster_33.tuerca, cluster_34.tuerca, cluster_26.tuerca, cluster_27.tuerca, cluster_24.tuerca, cluster_25.tuerca, cluster_62.tuerca, cluster_63.tuerca, cluster_60.tuerca, cluster_61.tuerca, cluster_44.tuerca, cluster_45.tuerca, cluster_42.tuerca, cluster_43.tuerca, cluster_71.tuerca, cluster_72.tuerca, cluster_69.tuerca, cluster_70.tuerca, cluster_53.tuerca, cluster_54.tuerca, cluster_51.tuerca, cluster_52.tuerca])

# ---- group: Tablero Inferior (continued)
diagnostico_2 = Panel(python_3_script_2.Out)
mesh_brep_6 = MeshBrep(
    Brep=python_3_script_2.NURBS_Color,
    Settings={GridMaxCount=0, GridMinCount=16, JaggedSeams=False, MaxEdgeLength=0, MinEdgeLength=0.0001, MinTolerance=0, Refine=True, RefineAngle=0, RelativeTolerance=0.65, SimplePlanes=True, Tolerance=0})
mesh_brep_7 = MeshBrep(
    Brep=python_3_script_2.NURBS_Balance,
    Settings={GridMaxCount=0, GridMinCount=16, JaggedSeams=False, MaxEdgeLength=0, MinEdgeLength=0.0001, MinTolerance=0, Refine=True, RefineAngle=0, RelativeTolerance=0.65, SimplePlanes=True, Tolerance=0})
mesh_brep_8 = MeshBrep(
    Brep=python_3_script_2.NURBS_MDP,
    Settings={GridMaxCount=0, GridMinCount=16, JaggedSeams=False, MaxEdgeLength=0, MinEdgeLength=0.0001, MinTolerance=0, Refine=True, RefineAngle=0, RelativeTolerance=0.65, SimplePlanes=True, Tolerance=0})
mesh_join_4 = MeshJoin(Meshes=flatten(mesh_brep_6))
mesh_join_5 = MeshJoin(Meshes=flatten(mesh_brep_7))
mesh_join_6 = MeshJoin(Meshes=flatten(mesh_brep_8))
reduce_mesh_2 = ReduceMesh(Mesh=mesh_join_6, FaceCount=20, Accuracy=1, FaceType=segmentacion_2, Distort=Toggle(False), Normalize=Toggle(True))  # -> Reduced, CountDifference
panel_11 = Panel(reduce_mesh_2.CountDifference)
python_3_script_6 = Python3Script(M=reduce_mesh_2.Reduced, B=rh_in_04_0_mapeado)  # -> a; inputs M: Mesh, B: list of Int32; same code as python_3_script_3
python_3_script_7 = Python3Script(M=mesh_join_5, B=rh_in_04_0_mapeado)  # -> a; inputs M: Mesh, B: list of Int32; same code as python_3_script_3
rh_out_mdp_tablero_inferior = Geometry(python_3_script_6)
rh_out_tablero_inferior_b = Geometry(python_3_script_7)

# Box Mapping 3.8
python_3_script_8 = Python3Script(M=mesh_join_4, B=rh_in_04_0_mapeado)  # -> a; inputs M: Mesh, B: list of Int32; same code as python_3_script_3

rh_out_tablero_inferior = Geometry(python_3_script_8)

# ==== cluster Cluster
punto_simetria = ClusterInput()
punto_0 = ClusterInput()
mecanizados = ClusterInput()
sujecion_herrajes = ClusterInput()
cambiar_lado = ClusterInput()
simetria = ClusterInput()
xz_plane = XZPlane(PuntoSimetria=punto_simetria)
xy_plane = XYPlane(Punto0=punto_0)
mirror = Mirror(Mecanizados=mecanizados, Plane=xz_plane)  # -> Geometry, Transform

# ----
# Tuerca
mesh = Mesh(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)
point = Point(Point(-407.5, 0, -7.755556303))

# ----
# Tornillo Largo
mesh_2 = Mesh(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)
point_2 = Point(Point(-300, 0, 41.10029089))

mesh_3 = Mesh(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)
point_3 = Point(Point(-205.9999456, 2.770490835e-05, 31.4500147))
# Minifix de Presion
mesh_4 = Mesh(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)
mesh_5 = Mesh(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)

# ----
# Minifix Roscado
mesh_6 = Mesh(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)
mesh_7 = Mesh(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)
point_4 = Point(Point(-605.9999456, 2.770490835e-05, 31.4500147))

# ----
# Tornillo PT
mesh_8 = Mesh(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)
point_5 = Point(Point(-500, 0, 32.94388492))

point_6 = Point(Point(-100, 0, 22))
# Tarugo
mesh_9 = Mesh(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)

vector_2pt = Vector2Pt(PointA=point, PointB=xy_plane, Unitize=False)  # -> Vector, Length
vector_2pt_2 = Vector2Pt(PointA=point_3, PointB=xy_plane, Unitize=False)  # -> Vector, Length
vector_2pt_3 = Vector2Pt(PointA=point_5, PointB=xy_plane, Unitize=False)  # -> Vector, Length
vector_2pt_4 = Vector2Pt(PointA=point_2, PointB=xy_plane, Unitize=False)  # -> Vector, Length
vector_2pt_5 = Vector2Pt(PointA=point_4, PointB=xy_plane, Unitize=False)  # -> Vector, Length
vector_2pt_6 = Vector2Pt(PointA=point_6, PointB=xy_plane, Unitize=False)  # -> Vector, Length
move = Move(Geometry=[mesh_4, mesh_5, mesh_3], Motion=vector_2pt_2.Vector)  # -> Geometry, Transform
move_2 = Move(Geometry=mesh, Motion=vector_2pt.Vector)  # -> Geometry, Transform
move_3 = Move(Geometry=mesh_8, Motion=vector_2pt_3.Vector)  # -> Geometry, Transform
move_4 = Move(Geometry=[mesh_6, mesh_7], Motion=vector_2pt_5.Vector)  # -> Geometry, Transform
move_5 = Move(Geometry=mesh_2, Motion=vector_2pt_4.Vector)  # -> Geometry, Transform
move_6 = Move(Geometry=mesh_9, Motion=vector_2pt_6.Vector)  # -> Geometry, Transform
mirror_2 = Mirror(Geometry=move.Geometry, Plane=xy_plane)  # -> Geometry, Transform
mirror_3 = Mirror(Geometry=move_3.Geometry, Plane=xy_plane)  # -> Geometry, Transform
mirror_4 = Mirror(Geometry=move_4.Geometry, Plane=xy_plane)  # -> Geometry, Transform
stream_filter = StreamFilter(Gate=simetria, Stream0=mecanizados, Stream1=flatten([mirror.Geometry, mecanizados]))
mirror_5 = Mirror(Geometry=move_5.Geometry, Plane=xy_plane)  # -> Geometry, Transform
mirror_6 = Mirror(Geometry=move_6.Geometry, Plane=xy_plane)  # -> Geometry, Transform
unit_z = UnitZ(Factor="-5")
rotate_3d = Rotate3D(Geometry=mirror_2.Geometry, Angle=degrees("180"), Center=xy_plane, Axis=Vector(0, 0, 1))  # -> Geometry, Transform
rotate_3d_2 = Rotate3D(Geometry=mirror_4.Geometry, Angle=degrees("180"), Center=xy_plane, Axis=Vector(0, 0, 1))  # -> Geometry, Transform
negative = Negative(Value=unit_z)
move_7 = Move(Geometry=move_2.Geometry, Motion=negative)  # -> Geometry, Transform
stream_filter_2 = StreamFilter(CambiarLadoMinifixRoscad=cambiar_lado, Stream0=mirror_4.Geometry, Stream1=rotate_3d_2.Geometry)
stream_filter_3 = StreamFilter(Gate=cambiar_lado, Stream0=mirror_2.Geometry, Stream1=rotate_3d.Geometry)
punto_tuerca = ClusterInput()
rotate_3d_3 = Rotate3D(Geometry=move_7.Geometry, Angle=degrees("180"), PuntoTuerca=punto_tuerca, Axis=Vector(0, 0, 1))  # -> Geometry, Transform
dispatch = Dispatch(List=stream_filter_3, DispatchPattern=[True, False])  # -> ListA, ListB
dispatch_2 = Dispatch(List=stream_filter_2, DispatchPattern=[True, False])  # -> ListA, ListB
dispatch_3 = Dispatch(List=dispatch.ListA, DispatchPattern=[True, False])  # -> ListA, ListB
stream_filter_4 = StreamFilter(CambiarLadoTuerca=cambiar_lado, Stream0=move_7.Geometry, Stream1=rotate_3d_3.Geometry)
stream_p_filter = StreamFilter(MinifixDePresion=sujecion_herrajes, Stream1=[dispatch.ListB, dispatch_3.ListA])
stream_filter_5 = StreamFilter(MinifixRoscado=sujecion_herrajes, Stream2=dispatch_2.ListA)
stream_filter_6 = StreamFilter(Tornillo_Largo=sujecion_herrajes, Stream3=mirror_5.Geometry)
stream_filter_7 = StreamFilter(Tornillo_PT=sujecion_herrajes, Stream4=mirror_3.Geometry)
stream_filter_8 = StreamFilter(Tuerca=sujecion_herrajes, Stream5=stream_filter_4)
stream_filter_9 = StreamFilter(Tarugo=sujecion_herrajes, Stream0=mirror_6.Geometry)
panel = Panel(sujecion_herrajes)
stream_filter_10 = StreamFilter(Gate=sujecion_herrajes, Stream1=dispatch_3.ListB, Stream2=dispatch_2.ListB)
mirror_7 = Mirror(Geometry=stream_filter_9, Plane=xz_plane)  # -> Geometry, Transform
mirror_8 = Mirror(Geometry=stream_filter_10, Plane=xz_plane)  # -> Geometry, Transform
mirror_9 = Mirror(Geometry=stream_p_filter, Plane=xz_plane)  # -> Geometry, Transform
mirror_10 = Mirror(Geometry=stream_filter_5, Plane=xz_plane)  # -> Geometry, Transform
mirror_11 = Mirror(Geometry=stream_filter_6, Plane=xz_plane)  # -> Geometry, Transform
mirror_12 = Mirror(Geometry=stream_filter_7, Plane=xz_plane)  # -> Geometry, Transform
mirror_13 = Mirror(Geometry=stream_filter_8, Plane=xz_plane)  # -> Geometry, Transform
stream_filter_11 = StreamFilter(Gate=simetria, Stream0=stream_filter_9, Stream1=[mirror_7.Geometry, stream_filter_9])
stream_filter_12 = StreamFilter(Gate=simetria, Stream0=stream_filter_10, Stream1=[mirror_8.Geometry, stream_filter_10])
stream_filter_13 = StreamFilter(Gate=simetria, Stream0=stream_p_filter, Stream1=[mirror_9.Geometry, stream_p_filter])
stream_filter_14 = StreamFilter(Gate=simetria, Stream0=stream_filter_5, Stream1=[stream_filter_5, mirror_10.Geometry])
stream_filter_15 = StreamFilter(Gate=simetria, Stream0=stream_filter_7, Stream1=[stream_filter_7, mirror_12.Geometry])
stream_filter_16 = StreamFilter(Gate=simetria, Stream0=stream_filter_6, Stream1=[stream_filter_6, mirror_11.Geometry])
stream_filter_17 = StreamFilter(Gate=simetria, Stream0=stream_filter_8, Stream1=[stream_filter_8, mirror_13.Geometry])
mecanizados_2 = ClusterOutput(stream_filter)
tarugo = ClusterOutput(stream_filter_11)
caja_minifix = ClusterOutput(stream_filter_12)
tornillo_pt = ClusterOutput(stream_filter_15)
tornillo_largo = ClusterOutput(stream_filter_16)
tuerca = ClusterOutput(stream_filter_17)
minifix_de_presion = ClusterOutput(stream_filter_13)
minifix_roscado = ClusterOutput(stream_filter_14)

# ==== cluster Cluster_2
sujecion_inferior_herraje = ClusterInput()
cambiar_lado = ClusterInput()
punto_0_internos = ClusterInput()

# ----
# Perforado Minifix
xy_plane = XYPlane(Origin=punto_0_internos)
xy_plane_2 = XYPlane(Origin=punto_0_internos)
cylinder = Cylinder(Base=xy_plane, Radius="3.5", Length="-22")
cylinder_2 = Cylinder(Base=xy_plane_2, Radius="2.5", Length="10")
cap_holes = CapHoles(Brep=cylinder)
cap_holes_2 = CapHoles(Brep=cylinder_2)
deconstruct_brep = DeconstructBrep(Brep=cap_holes)  # -> Faces, Edges, Vertices
list_item = ListItem(List=deconstruct_brep.Faces, Index="4", Wrap=True)
area = Area(Geometry=list_item)  # -> Area, Centroid
unit_z = UnitZ(Factor="-2")
move = Move(Geometry=area.Centroid, Motion=unit_z)  # -> Geometry, Transform
unit_x = UnitX(Factor="-4")
move_2 = Move(Geometry=move.Geometry, Motion=unit_x)  # -> Geometry, Transform
yz_plane = YZPlane(Origin=move_2.Geometry)
cylinder_3 = Cylinder(Base=yz_plane, Radius="7.5", Length="12")
cap_holes_3 = CapHoles(Brep=cylinder_3)
solid_union = SolidUnion(Breps=[cap_holes_3, cap_holes, cap_holes_2])
rotate_3d = Rotate3D(Geometry=solid_union, Angle=degrees("180"), PuntoRotacion=xy_plane, Axis=Vector(0, 0, 1))  # -> Geometry, Transform
stream_filter = StreamFilter(CambiarLado=cambiar_lado, Stream0=solid_union, Stream1=rotate_3d.Geometry)
mirror = Mirror(Geometry=stream_filter, Plane=xy_plane)  # -> Geometry, Transform
solid_union_2 = SolidUnion(Breps=mirror.Geometry)

# ----
# Perforado Tornillo Largo
xy_plane_3 = XYPlane(Origin=punto_0_internos)
cylinder_4 = Cylinder(Base=xy_plane_3, Radius="3", Length="-15")
cylinder_5 = Cylinder(Base=xy_plane_3, Radius="1.5", Length="-20")
cap_holes_4 = CapHoles(Brep=cylinder_4)
cap_holes_5 = CapHoles(Brep=cylinder_5)
mirror_2 = Mirror(Geometry=cap_holes_5, Plane=xy_plane)  # -> Geometry, Transform
solid_union_3 = SolidUnion(Breps=[mirror_2.Geometry, cap_holes_4])

# ----
# Perforado Tuerca
xy_plane_4 = XYPlane(Origin=punto_0_internos)
cylinder_6 = Cylinder(Base=xy_plane_4, Radius="3", Length="15")
cylinder_7 = Cylinder(Base=xy_plane_4, Radius="1.5", Length="-20")
cap_holes_6 = CapHoles(Brep=cylinder_6)
cap_holes_7 = CapHoles(Brep=cylinder_7)
deconstruct_brep_2 = DeconstructBrep(Brep=cap_holes_7)  # -> Faces, Edges, Vertices
list_item_2 = ListItem(List=deconstruct_brep_2.Faces, Index="1", Wrap=True)
area_2 = Area(Geometry=list_item_2)  # -> Area, Centroid
unit_x_2 = UnitX(Factor="-4")
move_3 = Move(Geometry=area_2.Centroid, Motion=unit_x_2)  # -> Geometry, Transform
yz_plane_2 = YZPlane(Origin=move_3.Geometry)
cylinder_8 = Cylinder(Base=yz_plane_2, Radius="6", Length="11.5")
cap_holes_8 = CapHoles(Brep=cylinder_8)
solid_union_4 = SolidUnion(Breps=[cap_holes_8, cap_holes_6, cap_holes_7])
rotate_3d_2 = Rotate3D(Geometry=solid_union_4, Angle=degrees("180"), PuntoRotacion=punto_0_internos, Axis=Vector(0, 0, 1))  # -> Geometry, Transform
stream_filter_2 = StreamFilter(CambiarLado=cambiar_lado, Stream0=solid_union_4, Stream1=rotate_3d_2.Geometry)
mirror_3 = Mirror(Geometry=stream_filter_2, Plane=xy_plane)  # -> Geometry, Transform
solid_union_5 = SolidUnion(Breps=mirror_3.Geometry)

# ----
# Perforado Tarugo
panel = Panel("10")
unit_z_2 = UnitZ(Factor=panel)
move_4 = Move(Geometry=punto_0_internos, Motion=unit_z_2)  # -> Geometry, Transform
xy_plane_5 = XYPlane(Origin=move_4.Geometry)
cylinder_9 = Cylinder(Base=xy_plane_5, Radius="4", Length="-32")
cap_holes_9 = CapHoles(Brep=cylinder_9)
mirror_4 = Mirror(Geometry=cap_holes_9, Plane=xy_plane)  # -> Geometry, Transform
solid_union_6 = SolidUnion(Breps=mirror_4.Geometry)

stream_filter_3 = StreamFilter(
    SujecionInferiorHerraje=sujecion_inferior_herraje,
    Stream0=solid_union_6,
    Stream1=solid_union_2,
    Stream2=solid_union_2,
    Stream3=solid_union_3,
    Stream4=solid_union_3,
    Stream5=solid_union_5)
solid_union_7 = SolidUnion(Breps=stream_filter_3)
punto_0_internos_2 = ClusterOutput(punto_0_internos)
punto_tuerca = ClusterOutput(xy_plane_4)
mecanizados = ClusterOutput(solid_union_7)

# ==== cluster Cluster_3
sujecion_inferior_herraje = ClusterInput()
cambiar_lado = ClusterInput()
punto_0_internos = ClusterInput()

# ----
# Perforado Tornillo Largo
xy_plane = XYPlane(Origin=punto_0_internos)
cylinder = Cylinder(Base=xy_plane, Radius="3", Length="15")
cylinder_2 = Cylinder(Base=xy_plane, Radius="1.5", Length="-20")
cap_holes = CapHoles(Brep=cylinder)
cap_holes_2 = CapHoles(Brep=cylinder_2)
solid_union = SolidUnion(Breps=[cap_holes, cap_holes_2])

# ----
# Perforado Tuerca
xy_plane_2 = XYPlane(Origin=punto_0_internos)
cylinder_3 = Cylinder(Base=xy_plane_2, Radius="3", Length="15")
cylinder_4 = Cylinder(Base=xy_plane_2, Radius="1.5", Length="-20")
cap_holes_3 = CapHoles(Brep=cylinder_3)
cap_holes_4 = CapHoles(Brep=cylinder_4)
deconstruct_brep = DeconstructBrep(Brep=cap_holes_4)  # -> Faces, Edges, Vertices
list_item = ListItem(List=deconstruct_brep.Faces, Index="1", Wrap=True)
area = Area(Geometry=list_item)  # -> Area, Centroid
unit_x = UnitX(Factor="-4")
move = Move(Geometry=area.Centroid, Motion=unit_x)  # -> Geometry, Transform
yz_plane = YZPlane(Origin=move.Geometry)
cylinder_5 = Cylinder(Base=yz_plane, Radius="6", Length="11.5")
cap_holes_5 = CapHoles(Brep=cylinder_5)
solid_union_2 = SolidUnion(Breps=[cap_holes_5, cap_holes_3, cap_holes_4])
rotate_3d = Rotate3D(Geometry=solid_union_2, Angle=degrees("180"), PuntoRotacion=punto_0_internos, Axis=Vector(0, 0, 1))  # -> Geometry, Transform
stream_filter = StreamFilter(CambiarLado=cambiar_lado, Stream0=solid_union_2, Stream1=rotate_3d.Geometry)
solid_union_3 = SolidUnion(Breps=stream_filter)

# ----
# Perforado Minifix
xy_plane_3 = XYPlane(Origin=punto_0_internos)
xy_plane_4 = XYPlane(Origin=punto_0_internos)
cylinder_6 = Cylinder(Base=xy_plane_3, Radius="3.5", Length="-22")
cylinder_7 = Cylinder(Base=xy_plane_4, Radius="2.5", Length="10")
cap_holes_6 = CapHoles(Brep=cylinder_6)
cap_holes_7 = CapHoles(Brep=cylinder_7)
deconstruct_brep_2 = DeconstructBrep(Brep=cap_holes_6)  # -> Faces, Edges, Vertices
list_item_2 = ListItem(List=deconstruct_brep_2.Faces, Index="4", Wrap=True)
area_2 = Area(Geometry=list_item_2)  # -> Area, Centroid
unit_z = UnitZ(Factor="-2")
move_2 = Move(Geometry=area_2.Centroid, Motion=unit_z)  # -> Geometry, Transform
unit_x_2 = UnitX(Factor="-4")
move_3 = Move(Geometry=move_2.Geometry, Motion=unit_x_2)  # -> Geometry, Transform
yz_plane_2 = YZPlane(Origin=move_3.Geometry)
cylinder_8 = Cylinder(Base=yz_plane_2, Radius="7.5", Length="12")
cap_holes_8 = CapHoles(Brep=cylinder_8)
solid_union_4 = SolidUnion(Breps=[cap_holes_8, cap_holes_6, cap_holes_7])
rotate_3d_2 = Rotate3D(Geometry=solid_union_4, Angle=degrees("180"), PuntoRotacion=xy_plane_3, Axis=Vector(0, 0, 1))  # -> Geometry, Transform
stream_filter_2 = StreamFilter(CambiarLado=cambiar_lado, Stream0=solid_union_4, Stream1=rotate_3d_2.Geometry)
solid_union_5 = SolidUnion(Breps=stream_filter_2)

# ----
# Perforado Tarugo
panel = Panel("10")
unit_z_2 = UnitZ(Factor=panel)
move_4 = Move(Geometry=punto_0_internos, Motion=unit_z_2)  # -> Geometry, Transform
xy_plane_5 = XYPlane(Origin=move_4.Geometry)
cylinder_9 = Cylinder(Base=xy_plane_5, Radius="4", Length="-32")
cap_holes_9 = CapHoles(Brep=cylinder_9)
solid_union_6 = SolidUnion(Breps=cap_holes_9)

stream_filter_3 = StreamFilter(
    SujecionInferiorHerraje=sujecion_inferior_herraje,
    Stream0=solid_union_6,
    Stream1=solid_union_5,
    Stream2=solid_union_5,
    Stream3=solid_union,
    Stream4=solid_union,
    Stream5=solid_union_3)
solid_union_7 = SolidUnion(Breps=stream_filter_3)
punto_0_externos = ClusterOutput(punto_0_internos)
punto_tuerca = ClusterOutput(xy_plane_2)
mecanizados = ClusterOutput(solid_union_7)

# ==== cluster Cluster_4
punto_simetria = ClusterInput()
sujecion_herrajes = ClusterInput()
cambiar_lado = ClusterInput()
punto_0 = ClusterInput()
mecanizados = ClusterInput()
simetria = ClusterInput()
xz_plane = XZPlane(PuntoSimetria=punto_simetria)
xy_plane = XYPlane(Punto0=punto_0)

# ----
# Tuerca
mesh = Mesh(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)
point = Point(Point(-407.5, 0, -7.755556303))

# ----
# Tornillo Largo
mesh_2 = Mesh(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)
point_2 = Point(Point(-300, 0, 41.10029089))

# ----
# Minifix de Presion
mesh_3 = Mesh(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)
mesh_4 = Mesh(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)
point_3 = Point(Point(-205.9999456, 2.770490835e-05, 31.4500147))
mesh_5 = Mesh(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)

# ----
# Minifix Roscado
mesh_6 = Mesh(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)
mesh_7 = Mesh(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)
point_4 = Point(Point(-605.9999456, 2.770490835e-05, 31.4500147))

# ----
# Tornillo PT
mesh_8 = Mesh(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)
point_5 = Point(Point(-500, 0, 32.94388492))

point_6 = Point(Point(-100, 0, 22))
# Tarugo
mesh_9 = Mesh(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)

mirror = Mirror(Mecanizados=mecanizados, Plane=xz_plane)  # -> Geometry, Transform
vector_2pt = Vector2Pt(PointA=point, PointB=xy_plane, Unitize=False)  # -> Vector, Length
unit_z = UnitZ(Factor="35")
vector_2pt_2 = Vector2Pt(PointA=point_3, PointB=xy_plane, Unitize=False)  # -> Vector, Length
vector_2pt_3 = Vector2Pt(PointA=point_5, PointB=xy_plane, Unitize=False)  # -> Vector, Length
vector_2pt_4 = Vector2Pt(PointA=point_2, PointB=xy_plane, Unitize=False)  # -> Vector, Length
vector_2pt_5 = Vector2Pt(PointA=point_4, PointB=xy_plane, Unitize=False)  # -> Vector, Length
vector_2pt_6 = Vector2Pt(PointA=point_6, PointB=xy_plane, Unitize=False)  # -> Vector, Length
move = Move(Geometry=mesh, Motion=vector_2pt.Vector)  # -> Geometry, Transform
move_2 = Move(Geometry=[mesh_3, mesh_5, mesh_4], Motion=vector_2pt_2.Vector)  # -> Geometry, Transform
negative = Negative(Value=unit_z)
move_3 = Move(Geometry=mesh_8, Motion=vector_2pt_3.Vector)  # -> Geometry, Transform
move_4 = Move(Geometry=[mesh_6, mesh_7], Motion=vector_2pt_5.Vector)  # -> Geometry, Transform
move_5 = Move(Geometry=mesh_2, Motion=vector_2pt_4.Vector)  # -> Geometry, Transform
move_6 = Move(Geometry=mesh_9, Motion=vector_2pt_6.Vector)  # -> Geometry, Transform
move_7 = Move(Geometry=move.Geometry, Motion=negative)  # -> Geometry, Transform
stream_filter = StreamFilter(Gate=simetria, Stream0=mecanizados, Stream1=flatten([mecanizados, mirror.Geometry]))
punto_tuerca = ClusterInput()
rotate_3d = Rotate3D(Geometry=move_7.Geometry, Angle=degrees("180"), PuntoTuerca=punto_tuerca, Axis=Vector(0, 0, 1))  # -> Geometry, Transform
rotate_3d_2 = Rotate3D(Geometry=move_2.Geometry, Angle=degrees("180"), Center=xy_plane, Axis=Vector(0, 0, 1))  # -> Geometry, Transform
rotate_3d_3 = Rotate3D(Geometry=move_4.Geometry, Angle=degrees("180"), Center=xy_plane, Axis=Vector(0, 0, 1))  # -> Geometry, Transform
stream_filter_2 = StreamFilter(CambiarLadoTuerca=0, Stream0=move_7.Geometry, Stream1=rotate_3d.Geometry)
stream_filter_3 = StreamFilter(CambiarLadoMinifixRoscad=cambiar_lado, Stream0=move_4.Geometry, Stream1=rotate_3d_3.Geometry)
stream_filter_4 = StreamFilter(Gate=cambiar_lado, Stream0=move_2.Geometry, Stream1=rotate_3d_2.Geometry)
dispatch = Dispatch(List=stream_filter_4, DispatchPattern=[True, False])  # -> ListA, ListB
dispatch_2 = Dispatch(List=stream_filter_3, DispatchPattern=[True, False])  # -> ListA, ListB
dispatch_3 = Dispatch(List=dispatch.ListA, DispatchPattern=[True, False])  # -> ListA, ListB
stream_p_filter = StreamFilter(MinifixDePresion=sujecion_herrajes, Stream1=[dispatch.ListB, dispatch_3.ListA])
stream_filter_5 = StreamFilter(MinifixRoscado=sujecion_herrajes, Stream2=dispatch_2.ListA)
stream_filter_6 = StreamFilter(Tornillo_Largo=sujecion_herrajes, Stream3=move_5.Geometry)
stream_filter_7 = StreamFilter(Tornillo_PT=sujecion_herrajes, Stream4=move_3.Geometry)
stream_filter_8 = StreamFilter(Tuerca=sujecion_herrajes, Stream5=stream_filter_2)
stream_filter_9 = StreamFilter(Tarugo=sujecion_herrajes, Stream0=move_6.Geometry)
panel = Panel(sujecion_herrajes)
stream_filter_10 = StreamFilter(Gate=sujecion_herrajes, Stream1=dispatch_3.ListB, Stream2=dispatch_2.ListB)
mirror_2 = Mirror(Geometry=stream_filter_9, Plane=xz_plane)  # -> Geometry, Transform
mirror_3 = Mirror(Geometry=stream_filter_10, Plane=xz_plane)  # -> Geometry, Transform
mirror_4 = Mirror(Geometry=stream_p_filter, Plane=xz_plane)  # -> Geometry, Transform
mirror_5 = Mirror(Geometry=stream_filter_5, Plane=xz_plane)  # -> Geometry, Transform
mirror_6 = Mirror(Geometry=stream_filter_6, Plane=xz_plane)  # -> Geometry, Transform
mirror_7 = Mirror(Geometry=stream_filter_7, Plane=xz_plane)  # -> Geometry, Transform
mirror_8 = Mirror(Geometry=stream_filter_8, Plane=xz_plane)  # -> Geometry, Transform
stream_filter_11 = StreamFilter(Gate=simetria, Stream0=stream_filter_9, Stream1=[mirror_2.Geometry, stream_filter_9])
stream_filter_12 = StreamFilter(Gate=simetria, Stream0=stream_filter_10, Stream1=[mirror_3.Geometry, stream_filter_10])
stream_filter_13 = StreamFilter(Gate=simetria, Stream0=stream_p_filter, Stream1=[mirror_4.Geometry, stream_p_filter])
stream_filter_14 = StreamFilter(Gate=simetria, Stream0=stream_filter_5, Stream1=[stream_filter_5, mirror_5.Geometry])
stream_filter_15 = StreamFilter(Gate=simetria, Stream0=stream_filter_7, Stream1=[stream_filter_7, mirror_7.Geometry])
stream_filter_16 = StreamFilter(Gate=simetria, Stream0=stream_filter_6, Stream1=[stream_filter_6, mirror_6.Geometry])
stream_filter_17 = StreamFilter(Gate=simetria, Stream0=stream_filter_8, Stream1=[stream_filter_8, mirror_8.Geometry])
mecanizados_2 = ClusterOutput(stream_filter)
tarugo = ClusterOutput(stream_filter_11)
caja_minifix = ClusterOutput(stream_filter_12)
tornillo_pt = ClusterOutput(stream_filter_15)
tornillo_largo = ClusterOutput(stream_filter_16)
tuerca = ClusterOutput(stream_filter_17)
minifix_de_presion = ClusterOutput(stream_filter_13)
minifix_roscado = ClusterOutput(stream_filter_14)

# ==== cluster Cluster_5
sujecion_inferior_herraje = ClusterInput()
cambiar_lado = ClusterInput()
punto_0_internos = ClusterInput()

# ----
# Perforado Tornillo Largo
xy_plane = XYPlane(Origin=punto_0_internos)
cylinder = Cylinder(Base=xy_plane, Radius="3", Length="15")
cylinder_2 = Cylinder(Base=xy_plane, Radius="1.5", Length="-20")
cap_holes = CapHoles(Brep=cylinder)
cap_holes_2 = CapHoles(Brep=cylinder_2)
solid_union = SolidUnion(Breps=[cap_holes, cap_holes_2])

# ----
# Perforado Tuerca
xy_plane_2 = XYPlane(Origin=punto_0_internos)
cylinder_3 = Cylinder(Base=xy_plane_2, Radius="3", Length="15")
cylinder_4 = Cylinder(Base=xy_plane_2, Radius="1.5", Length="-20")
cap_holes_3 = CapHoles(Brep=cylinder_3)
cap_holes_4 = CapHoles(Brep=cylinder_4)
deconstruct_brep = DeconstructBrep(Brep=cap_holes_4)  # -> Faces, Edges, Vertices
list_item = ListItem(List=deconstruct_brep.Faces, Index="1", Wrap=True)
area = Area(Geometry=list_item)  # -> Area, Centroid
unit_x = UnitX(Factor="-4")
move = Move(Geometry=area.Centroid, Motion=unit_x)  # -> Geometry, Transform
yz_plane = YZPlane(Origin=move.Geometry)
cylinder_5 = Cylinder(Base=yz_plane, Radius="6", Length="11.5")
cap_holes_5 = CapHoles(Brep=cylinder_5)
solid_union_2 = SolidUnion(Breps=[cap_holes_5, cap_holes_3, cap_holes_4])
rotate_3d = Rotate3D(Geometry=solid_union_2, Angle=degrees("180"), PuntoRotacion=punto_0_internos, Axis=Vector(0, 0, 1))  # -> Geometry, Transform
stream_filter = StreamFilter(CambiarLado=cambiar_lado, Stream0=solid_union_2, Stream1=rotate_3d.Geometry)
solid_union_3 = SolidUnion(Breps=stream_filter)

# ----
# Perforado Minifix
xy_plane_3 = XYPlane(Origin=punto_0_internos)
xy_plane_4 = XYPlane(Origin=punto_0_internos)
cylinder_6 = Cylinder(Base=xy_plane_3, Radius="3.5", Length="-22")
cylinder_7 = Cylinder(Base=xy_plane_4, Radius="2.5", Length="10")
cap_holes_6 = CapHoles(Brep=cylinder_6)
cap_holes_7 = CapHoles(Brep=cylinder_7)
deconstruct_brep_2 = DeconstructBrep(Brep=cap_holes_6)  # -> Faces, Edges, Vertices
list_item_2 = ListItem(List=deconstruct_brep_2.Faces, Index="4", Wrap=True)
area_2 = Area(Geometry=list_item_2)  # -> Area, Centroid
unit_z = UnitZ(Factor="-2")
move_2 = Move(Geometry=area_2.Centroid, Motion=unit_z)  # -> Geometry, Transform
unit_x_2 = UnitX(Factor="-4")
move_3 = Move(Geometry=move_2.Geometry, Motion=unit_x_2)  # -> Geometry, Transform
yz_plane_2 = YZPlane(Origin=move_3.Geometry)
cylinder_8 = Cylinder(Base=yz_plane_2, Radius="7.5", Length="12")
cap_holes_8 = CapHoles(Brep=cylinder_8)
solid_union_4 = SolidUnion(Breps=[cap_holes_8, cap_holes_6, cap_holes_7])
rotate_3d_2 = Rotate3D(Geometry=solid_union_4, Angle=degrees("180"), PuntoRotacion=xy_plane_3, Axis=Vector(0, 0, 1))  # -> Geometry, Transform
stream_filter_2 = StreamFilter(CambiarLado=cambiar_lado, Stream0=solid_union_4, Stream1=rotate_3d_2.Geometry)
solid_union_5 = SolidUnion(Breps=stream_filter_2)

# ----
# Perforado Tarugo
panel = Panel("10")
unit_z_2 = UnitZ(Factor=panel)
move_4 = Move(Geometry=punto_0_internos, Motion=unit_z_2)  # -> Geometry, Transform
xy_plane_5 = XYPlane(Origin=move_4.Geometry)
cylinder_9 = Cylinder(Base=xy_plane_5, Radius="4", Length="-32")
cap_holes_9 = CapHoles(Brep=cylinder_9)
solid_union_6 = SolidUnion(Breps=cap_holes_9)

stream_filter_3 = StreamFilter(
    SujecionInferiorHerraje=sujecion_inferior_herraje,
    Stream0=solid_union_6,
    Stream1=solid_union_5,
    Stream2=solid_union_5,
    Stream3=solid_union,
    Stream4=solid_union,
    Stream5=solid_union_3)
solid_union_7 = SolidUnion(Breps=stream_filter_3)
punto_0_internos_2 = ClusterOutput(punto_0_internos)
punto_tuerca = ClusterOutput(xy_plane_2)
mecanizados = ClusterOutput(solid_union_7)

# ==== cluster Cluster_6
relay = ClusterInput()
posicion_externos_inferior = ClusterInput()
posicion_internos_inferior = ClusterInput()

# ----
# Posicionador Borde Inferior
deconstruct_brep = DeconstructBrep(Pieza=relay)  # -> Faces, Edges, Vertices
list_item = ListItem(List=deconstruct_brep.Edges, Index="2", Wrap=True)
list_item_2 = ListItem(List=deconstruct_brep.Faces, Index="4", Wrap=True)
curve_middle = CurveMiddle(Curve=list_item)
area = Area(Geometry=list_item_2)  # -> Area, Centroid
line = Line(StartPoint=area.Centroid, EndPoint=curve_middle)
length = Length(Curve=line)
panel = Panel(length)
distancia_minima_al_borde = Panel("20")
subtraction = Subtraction(A=panel, B=distancia_minima_al_borde)
paso_maquinas = Panel("32")
division = Division(A=subtraction, B=paso_maquinas)
panel_2 = Panel(division)
round = Round(Number=panel_2)  # -> Nearest, Floor, Ceiling
panel_3 = Panel(round.Floor)
subtraction_2 = Subtraction(A=panel_3, B=posicion_internos_inferior)
subtraction_3 = Subtraction(A=panel_3, B=posicion_externos_inferior)
multiplication = Multiplication(A=subtraction_3, B=paso_maquinas)
multiplication_2 = Multiplication(A=subtraction_2, B=paso_maquinas)
unit_y = UnitY(Factor=multiplication)
unit_y_2 = UnitY(Factor=multiplication_2)
move = Move(Punto0Externos=area.Centroid, Posicion=unit_y)  # -> Geometry, Transform
move_2 = Move(Punto0Internos=area.Centroid, Posicion=unit_y_2)  # -> Geometry, Transform

posicion_internos_superior = ClusterInput()
posicion_externos_superior = ClusterInput()

# ----
# Posicionador Borde Superior
deconstruct_brep_2 = DeconstructBrep(Pieza=relay)  # -> Faces, Edges, Vertices
list_item_3 = ListItem(List=deconstruct_brep_2.Edges, Index="18", Wrap=True)
list_item_4 = ListItem(List=deconstruct_brep_2.Faces, Index="5", Wrap=True)
curve_middle_2 = CurveMiddle(Curve=list_item_3)
area_2 = Area(Geometry=list_item_4)  # -> Area, Centroid
line_2 = Line(StartPoint=area_2.Centroid, EndPoint=curve_middle_2)
length_2 = Length(Curve=line_2)
panel_4 = Panel(length_2)
distancia_minima_al_borde_2 = Panel("20")
subtraction_4 = Subtraction(A=panel_4, B=distancia_minima_al_borde_2)
paso_maquinas_2 = Panel("32")
division_2 = Division(A=subtraction_4, B=paso_maquinas_2)
panel_5 = Panel(division_2)
round_2 = Round(Number=panel_5)  # -> Nearest, Floor, Ceiling
panel_6 = Panel(round_2.Floor)
subtraction_5 = Subtraction(A=panel_6, B=posicion_internos_superior)
subtraction_6 = Subtraction(A=panel_6, B=posicion_externos_superior)
multiplication_3 = Multiplication(A=subtraction_6, B=paso_maquinas_2)
multiplication_4 = Multiplication(A=subtraction_5, B=paso_maquinas_2)
unit_y_3 = UnitY(Factor=multiplication_3)
unit_y_4 = UnitY(Factor=multiplication_4)
move_3 = Move(Geometry=area_2.Centroid, Posicion=unit_y_3)  # -> Geometry, Transform
move_4 = Move(Geometry=area_2.Centroid, Posicion=unit_y_4)  # -> Geometry, Transform

punto_de_simetria_inferior = ClusterOutput(area.Centroid)
punto_de_simetria_superior = ClusterOutput(area_2.Centroid)
punto_0_externos_inferior = ClusterOutput(move.Geometry)
punto_0_internos_inferior = ClusterOutput(move_2.Geometry)
punto_0_externos_superior = ClusterOutput(move_3.Geometry)
punto_0_internos_superior = ClusterOutput(move_4.Geometry)
